# Grasshopper definition massPlan.gh (Grasshopper 1.0.7)

# space module (m2)
number_slider = Slider(43, range=0..100)
number_slider_2 = Slider(4983, range=0..10000)
# 건물 width
# 복도폭
number_slider_3 = Slider(20890.563, range=0..100000)
# core count
toggle = BooleanToggle(True)
# 커브 선택
crv = Curve(<curve referenced from the Rhino model>)
neg = Negative(Value=number_slider_3)
neg_2 = Negative(Value=number_slider_2)
subtraction = Subtraction(A=number_slider_3, B=number_slider_2)
len = Length(Curve=crv)
offset = OffsetCurve(Curve=crv, Distance=expr("x / 2", [number_slider_3, neg]), Corners=1)
offset_2 = OffsetCurve(Curve=crv, Distance=expr("x / 2", [number_slider_2, neg_2]), Corners=1)  # -> flatten(Curve)
multiplication = Multiplication(A=number_slider, B="1e6")
end = EndPoints(Curve=offset)  # -> flatten(Start), flatten(End)
division = Division(A=subtraction, B="2")
len_2 = Length(Curve=offset_2)
item = ListItem(List=end.Start, Index=0, Wrap=True)  # -> Item, Item1
item_2 = ListItem(List=end.End, Index=0, Wrap=True)  # -> Item, Item1
sort = SortList(Keys=len_2, ValuesA=offset_2)  # -> Keys, ValuesA
division_2 = Division(A=multiplication, B=division)
ln = Line(StartPoint=item.Item, EndPoint=item.Item1)
ln_2 = Line(StartPoint=item_2.Item, EndPoint=item_2.Item1)
join = JoinCurves(Curves=flatten([ln, ln_2, offset]), Preserve=False)
item_3 = ListItem(List=sort.ValuesA, Index=0, Wrap=True)
merge = Merge(Data1=flatten(offset), Data2=offset_2)
divide = DivideCurve(Curve=item_3, Count=expr("x * 2", Slider(3, range=0..10)), Kinks=False)  # -> Points, Tangents, Parameters
offset_3 = OffsetCurve(Curve=join, Distance="75", Corners=1)
len_3 = Length(Curve=merge)
panel = Panel("""0
2""")
dispatch = Dispatch(List=divide.Points, DispatchPattern=[True, False])  # -> ListA, ListB
sort_2 = SortList(Keys=len_3, ValuesA=merge)  # -> Keys, reverse(ValuesA)
addition = Addition(A=toggle, B=panel)
boundary = BoundarySurfaces()
item_4 = ListItem(List=sort_2.ValuesA, Index=addition, Wrap=True)

divlength = DivideLength(Curve=item_4, Length=division_2)  # -> Points, Tangents, Parameters
Z = UnitZ(Factor=1)
neg_3 = Negative(Value=Z)
cull_i = CullIndex(List=divlength.Points, Indices="-1", Wrap=True)
xprod = CrossProduct(VectorA=divlength.Tangents, VectorB=neg_3, Unitize=False)  # -> Vector, Length
pl = ConstructPlane(Origin=cull_i, XAxis=divlength.Tangents, YAxis=xprod.Vector)

preview = CustomPreview(Geometry=boundary, Material=ColourSwatch(SwatchColor=RGB(130, 130, 130)))
rectangle = Rectangle(Plane=divlength.Points, XSize=division_2, YSize=division, Radius=0)  # -> Rectangle, Length
orient = Orient(Geometry=rectangle.Rectangle, Source=divlength.Points, Target=pl)  # -> flatten(Geometry), Transform
area = Area(Geometry=orient.Geometry)  # -> Area, Centroid
number_slider_4 = Slider(75, range=0..1000)
cp = ClosestPoint(Point=dispatch.ListB, Cloud=area.Centroid)  # -> ClosestPoint, CPIndex, Distance
item_5 = ListItem(List=orient.Geometry, Index=cp.CPIndex, Wrap=True)
neg_4 = Negative(Value=number_slider_4)
merge_2 = Merge(Data1=number_slider_4, Data2=neg_4)  # -> graft(Result)
cull_i_2 = CullIndex(List=orient.Geometry, Indices=cp.CPIndex, Wrap=True)
boundary_2 = BoundarySurfaces(Edges=item_5)
offset_4 = OffsetCurve(Curve=cull_i_2, Distance=merge_2, Corners=1)
runion = RegionUnion()
preview_2 = CustomPreview(Geometry=boundary_2, Material=ColourSwatch(SwatchColor=RGB(0, 0, 0)))
boundary_3 = BoundarySurfaces()
