# Grasshopper definition mapmodeling.gh (Grasshopper 1.0.7)
# plug-ins: atit

# 인도
panel = Panel(""""C:\Users\BaekInchan\Desktop\설계스튜디오9_졸업설계\맵모델링\압구정\N3A_A0010000.shp"
"C:\Users\BaekInchan\Desktop\설계스튜디오9_졸업설계\맵모델링\압구정\N3A_A0033320.shp"
"C:\Users\BaekInchan\Desktop\설계스튜디오9_졸업설계\맵모델링\압구정\N3A_A0053326.shp"
"C:\Users\BaekInchan\Desktop\설계스튜디오9_졸업설계\맵모델링\압구정\N3A_A0063321.shp"
"C:\Users\BaekInchan\Desktop\설계스튜디오9_졸업설계\맵모델링\압구정\N3A_A0070000.shp"
"C:\Users\BaekInchan\Desktop\설계스튜디오9_졸업설계\맵모델링\압구정\N3A_A0080000.shp"
"C:\Users\BaekInchan\Desktop\설계스튜디오9_졸업설계\맵모델링\압구정\N3A_A0090000.shp"
"C:\Users\BaekInchan\Desktop\설계스튜디오9_졸업설계\맵모델링\압구정\N3A_A0100000.shp"
"C:\Users\BaekInchan\Desktop\설계스튜디오9_졸업설계\맵모델링\압구정\N3A_A0110020.shp"
"C:\Users\BaekInchan\Desktop\설계스튜디오9_졸업설계\맵모델링\압구정\N3A_A0160024.shp"
"C:\Users\BaekInchan\Desktop\설계스튜디오9_졸업설계\맵모델링\압구정\N3A_A0191221.shp"
"C:\Users\BaekInchan\Desktop\설계스튜디오9_졸업설계\맵모델링\압구정\N3A_A0201222.shp"
"C:\Users\BaekInchan\Desktop\설계스튜디오9_졸업설계\맵모델링\압구정\N3A_B0010000.shp"
"C:\Users\BaekInchan\Desktop\설계스튜디오9_졸업설계\맵모델링\압구정\N3A_C0186115.shp"
"C:\Users\BaekInchan\Desktop\설계스튜디오9_졸업설계\맵모델링\압구정\N3A_C0390000.shp"
"C:\Users\BaekInchan\Desktop\설계스튜디오9_졸업설계\맵모델링\압구정\N3A_C0423365.shp"
"C:\Users\BaekInchan\Desktop\설계스튜디오9_졸업설계\맵모델링\압구정\N3A_C0430000.shp"
"C:\Users\BaekInchan\Desktop\설계스튜디오9_졸업설계\맵모델링\압구정\N3A_D0010000.shp"
"C:\Users\BaekInchan\Desktop\설계스튜디오9_졸업설계\맵모델링\압구정\N3A_E0010001.shp"
"C:\Users\BaekInchan\Desktop\설계스튜디오9_졸업설계\맵모델링\압구정\N3A_E0032111.shp"
"C:\Users\BaekInchan\Desktop\설계스튜디오9_졸업설계\맵모델링\압구정\N3A_E0052114.shp"
"C:\Users\BaekInchan\Desktop\설계스튜디오9_졸업설계\맵모델링\압구정\N3A_G0010000.shp"
"C:\Users\BaekInchan\Desktop\설계스튜디오9_졸업설계\맵모델링\압구정\N3A_G0020000.shp"
"C:\Users\BaekInchan\Desktop\설계스튜디오9_졸업설계\맵모델링\압구정\N3L_A0010000.shp"
"C:\Users\BaekInchan\Desktop\설계스튜디오9_졸업설계\맵모델링\압구정\N3L_A0020000.shp"
"C:\Users\BaekInchan\Desktop\설계스튜디오9_졸업설계\맵모델링\압구정\N3L_A0033330.shp"
"C:\Users\BaekInchan\Desktop\설계스튜디오9_졸업설계\맵모델링\압구정\N3L_A0123373.shp"
"C:\Users\BaekInchan\Desktop\설계스튜디오9_졸업설계\맵모델링\압구정\N3L_A0150000.shp"
"C:\Users\BaekInchan\Desktop\설계스튜디오9_졸업설계\맵모델링\압구정\N3L_A0171119.shp"
"C:\Users\BaekInchan\Desktop\설계스튜디오9_졸업설계\맵모델링\압구정\N3L_B0020000.shp"
"C:\Users\BaekInchan\Desktop\설계스튜디오9_졸업설계\맵모델링\압구정\N3L_C0050000.shp"
"C:\Users\BaekInchan\Desktop\설계스튜디오9_졸업설계\맵모델링\압구정\N3L_C0060000.shp"
"C:\Users\BaekInchan\Desktop\설계스튜디오9_졸업설계\맵모델링\압구정\N3L_C0070000.shp"
"C:\Users\BaekInchan\Desktop\설계스튜디오9_졸업설계\맵모델링\압구정\N3L_C0520000.shp"
"C:\Users\BaekInchan\Desktop\설계스튜디오9_졸업설계\맵모델링\압구정\N3L_E0020000.shp"
"C:\Users\BaekInchan\Desktop\설계스튜디오9_졸업설계\맵모델링\압구정\N3L_F0010000.shp"
"C:\Users\BaekInchan\Desktop\설계스튜디오9_졸업설계\맵모델링\압구정\N3L_F0030000.shp"
"C:\Users\BaekInchan\Desktop\설계스튜디오9_졸업설계\맵모델링\압구정\N3L_F0040000.shp"
"C:\Users\BaekInchan\Desktop\설계스튜디오9_졸업설계\맵모델링\압구정\N3L_G0030000.shp"
"C:\Users\BaekInchan\Desktop\설계스튜디오9_졸업설계\맵모델링\압구정\N3L_H0010000.shp"
"C:\Users\BaekInchan\Desktop\설계스튜디오9_졸업설계\맵모델링\압구정\N3P_A0131122.shp"
"C:\Users\BaekInchan\Desktop\설계스튜디오9_졸업설계\맵모델링\압구정\N3P_C0210000.shp"
"C:\Users\BaekInchan\Desktop\설계스튜디오9_졸업설계\맵모델링\압구정\N3P_C0380000.shp"
"C:\Users\BaekInchan\Desktop\설계스튜디오9_졸업설계\맵모델링\압구정\N3P_D0030000.shp"
"C:\Users\BaekInchan\Desktop\설계스튜디오9_졸업설계\맵모델링\압구정\N3P_E0042326.shp"
"C:\Users\BaekInchan\Desktop\설계스튜디오9_졸업설계\맵모델링\압구정\N3P_F0020000.shp"
"C:\Users\BaekInchan\Desktop\설계스튜디오9_졸업설계\맵모델링\압구정\N3P_H0020000.shp"
"C:\Users\BaekInchan\Desktop\설계스튜디오9_졸업설계\맵모델링\압구정\N3P_H0040000.shp"
"C:\Users\BaekInchan\Desktop\설계스튜디오9_졸업설계\맵모델링\압구정\N3P_H0059153.shp"
""")
panel_2 = Panel(""""C:\Users\BaekInchan\Desktop\설계스튜디오9_졸업설계\맵모델링\신사\N3P_H0059153.shp"
"C:\Users\BaekInchan\Desktop\설계스튜디오9_졸업설계\맵모델링\신사\N3A_A0010000.shp"
"C:\Users\BaekInchan\Desktop\설계스튜디오9_졸업설계\맵모델링\신사\N3A_A0033320.shp"
"C:\Users\BaekInchan\Desktop\설계스튜디오9_졸업설계\맵모델링\신사\N3A_A0053326.shp"
"C:\Users\BaekInchan\Desktop\설계스튜디오9_졸업설계\맵모델링\신사\N3A_A0063321.shp"
"C:\Users\BaekInchan\Desktop\설계스튜디오9_졸업설계\맵모델링\신사\N3A_A0070000.shp"
"C:\Users\BaekInchan\Desktop\설계스튜디오9_졸업설계\맵모델링\신사\N3A_A0080000.shp"
"C:\Users\BaekInchan\Desktop\설계스튜디오9_졸업설계\맵모델링\신사\N3A_A0090000.shp"
"C:\Users\BaekInchan\Desktop\설계스튜디오9_졸업설계\맵모델링\신사\N3A_A0100000.shp"
"C:\Users\BaekInchan\Desktop\설계스튜디오9_졸업설계\맵모델링\신사\N3A_A0110020.shp"
"C:\Users\BaekInchan\Desktop\설계스튜디오9_졸업설계\맵모델링\신사\N3A_A0160024.shp"
"C:\Users\BaekInchan\Desktop\설계스튜디오9_졸업설계\맵모델링\신사\N3A_A0191221.shp"
"C:\Users\BaekInchan\Desktop\설계스튜디오9_졸업설계\맵모델링\신사\N3A_A0201222.shp"
"C:\Users\BaekInchan\Desktop\설계스튜디오9_졸업설계\맵모델링\신사\N3A_B0010000.shp"
"C:\Users\BaekInchan\Desktop\설계스튜디오9_졸업설계\맵모델링\신사\N3A_C0186115.shp"
"C:\Users\BaekInchan\Desktop\설계스튜디오9_졸업설계\맵모델링\신사\N3A_C0390000.shp"
"C:\Users\BaekInchan\Desktop\설계스튜디오9_졸업설계\맵모델링\신사\N3A_C0423365.shp"
"C:\Users\BaekInchan\Desktop\설계스튜디오9_졸업설계\맵모델링\신사\N3A_C0430000.shp"
"C:\Users\BaekInchan\Desktop\설계스튜디오9_졸업설계\맵모델링\신사\N3A_D0010000.shp"
"C:\Users\BaekInchan\Desktop\설계스튜디오9_졸업설계\맵모델링\신사\N3A_E0010001.shp"
"C:\Users\BaekInchan\Desktop\설계스튜디오9_졸업설계\맵모델링\신사\N3A_E0032111.shp"
"C:\Users\BaekInchan\Desktop\설계스튜디오9_졸업설계\맵모델링\신사\N3A_E0052114.shp"
"C:\Users\BaekInchan\Desktop\설계스튜디오9_졸업설계\맵모델링\신사\N3A_G0010000.shp"
"C:\Users\BaekInchan\Desktop\설계스튜디오9_졸업설계\맵모델링\신사\N3A_G0020000.shp"
"C:\Users\BaekInchan\Desktop\설계스튜디오9_졸업설계\맵모델링\신사\N3L_A0010000.shp"
"C:\Users\BaekInchan\Desktop\설계스튜디오9_졸업설계\맵모델링\신사\N3L_A0020000.shp"
"C:\Users\BaekInchan\Desktop\설계스튜디오9_졸업설계\맵모델링\신사\N3L_A0033320.shp"
"C:\Users\BaekInchan\Desktop\설계스튜디오9_졸업설계\맵모델링\신사\N3L_A0123373.shp"
"C:\Users\BaekInchan\Desktop\설계스튜디오9_졸업설계\맵모델링\신사\N3L_A0150000.shp"
"C:\Users\BaekInchan\Desktop\설계스튜디오9_졸업설계\맵모델링\신사\N3L_A0171119.shp"
"C:\Users\BaekInchan\Desktop\설계스튜디오9_졸업설계\맵모델링\신사\N3L_B0020000.shp"
"C:\Users\BaekInchan\Desktop\설계스튜디오9_졸업설계\맵모델링\신사\N3L_C0050000.shp"
"C:\Users\BaekInchan\Desktop\설계스튜디오9_졸업설계\맵모델링\신사\N3L_C0060000.shp"
"C:\Users\BaekInchan\Desktop\설계스튜디오9_졸업설계\맵모델링\신사\N3L_C0520000.shp"
"C:\Users\BaekInchan\Desktop\설계스튜디오9_졸업설계\맵모델링\신사\N3L_E0020000.shp"
"C:\Users\BaekInchan\Desktop\설계스튜디오9_졸업설계\맵모델링\신사\N3L_F0010000.shp"
"C:\Users\BaekInchan\Desktop\설계스튜디오9_졸업설계\맵모델링\신사\N3L_F0030000.shp"
"C:\Users\BaekInchan\Desktop\설계스튜디오9_졸업설계\맵모델링\신사\N3L_F0040000.shp"
"C:\Users\BaekInchan\Desktop\설계스튜디오9_졸업설계\맵모델링\신사\N3L_G0030000.shp"
"C:\Users\BaekInchan\Desktop\설계스튜디오9_졸업설계\맵모델링\신사\N3L_H0010000.shp"
"C:\Users\BaekInchan\Desktop\설계스튜디오9_졸업설계\맵모델링\신사\N3P_A0131122.shp"
"C:\Users\BaekInchan\Desktop\설계스튜디오9_졸업설계\맵모델링\신사\N3P_C0380000.shp"
"C:\Users\BaekInchan\Desktop\설계스튜디오9_졸업설계\맵모델링\신사\N3P_E0042326.shp"
"C:\Users\BaekInchan\Desktop\설계스튜디오9_졸업설계\맵모델링\신사\N3P_F0020000.shp"
"C:\Users\BaekInchan\Desktop\설계스튜디오9_졸업설계\맵모델링\신사\N3P_H0020000.shp"
"C:\Users\BaekInchan\Desktop\설계스튜디오9_졸업설계\맵모델링\신사\N3P_H0040000.shp"
""")
panel_3 = Panel(""""C:\Users\BaekInchan\Desktop\설계스튜디오9_졸업설계\맵모델링\강남구청\(B010)수치지도_37705092_2022_00000597055733\N3P_H0040000.shp"
"C:\Users\BaekInchan\Desktop\설계스튜디오9_졸업설계\맵모델링\강남구청\(B010)수치지도_37705092_2022_00000597055733\N3A_A0010000.shp"
"C:\Users\BaekInchan\Desktop\설계스튜디오9_졸업설계\맵모델링\강남구청\(B010)수치지도_37705092_2022_00000597055733\N3A_A0033320.shp"
"C:\Users\BaekInchan\Desktop\설계스튜디오9_졸업설계\맵모델링\강남구청\(B010)수치지도_37705092_2022_00000597055733\N3A_A0053326.shp"
"C:\Users\BaekInchan\Desktop\설계스튜디오9_졸업설계\맵모델링\강남구청\(B010)수치지도_37705092_2022_00000597055733\N3A_A0080000.shp"
"C:\Users\BaekInchan\Desktop\설계스튜디오9_졸업설계\맵모델링\강남구청\(B010)수치지도_37705092_2022_00000597055733\N3A_B0010000.shp"
"C:\Users\BaekInchan\Desktop\설계스튜디오9_졸업설계\맵모델링\강남구청\(B010)수치지도_37705092_2022_00000597055733\N3A_C0186115.shp"
"C:\Users\BaekInchan\Desktop\설계스튜디오9_졸업설계\맵모델링\강남구청\(B010)수치지도_37705092_2022_00000597055733\N3A_C0305316.shp"
"C:\Users\BaekInchan\Desktop\설계스튜디오9_졸업설계\맵모델링\강남구청\(B010)수치지도_37705092_2022_00000597055733\N3A_C0390000.shp"
"C:\Users\BaekInchan\Desktop\설계스튜디오9_졸업설계\맵모델링\강남구청\(B010)수치지도_37705092_2022_00000597055733\N3A_C0423365.shp"
"C:\Users\BaekInchan\Desktop\설계스튜디오9_졸업설계\맵모델링\강남구청\(B010)수치지도_37705092_2022_00000597055733\N3A_C0430000.shp"
"C:\Users\BaekInchan\Desktop\설계스튜디오9_졸업설계\맵모델링\강남구청\(B010)수치지도_37705092_2022_00000597055733\N3A_G0010000.shp"
"C:\Users\BaekInchan\Desktop\설계스튜디오9_졸업설계\맵모델링\강남구청\(B010)수치지도_37705092_2022_00000597055733\N3L_A0010000.shp"
"C:\Users\BaekInchan\Desktop\설계스튜디오9_졸업설계\맵모델링\강남구청\(B010)수치지도_37705092_2022_00000597055733\N3L_A0020000.shp"
"C:\Users\BaekInchan\Desktop\설계스튜디오9_졸업설계\맵모델링\강남구청\(B010)수치지도_37705092_2022_00000597055733\N3L_A0033330.shp"
"C:\Users\BaekInchan\Desktop\설계스튜디오9_졸업설계\맵모델링\강남구청\(B010)수치지도_37705092_2022_00000597055733\N3L_B0020000.shp"
"C:\Users\BaekInchan\Desktop\설계스튜디오9_졸업설계\맵모델링\강남구청\(B010)수치지도_37705092_2022_00000597055733\N3L_C0070000.shp"
"C:\Users\BaekInchan\Desktop\설계스튜디오9_졸업설계\맵모델링\강남구청\(B010)수치지도_37705092_2022_00000597055733\N3L_C0520000.shp"
"C:\Users\BaekInchan\Desktop\설계스튜디오9_졸업설계\맵모델링\강남구청\(B010)수치지도_37705092_2022_00000597055733\N3L_E0020000.shp"
"C:\Users\BaekInchan\Desktop\설계스튜디오9_졸업설계\맵모델링\강남구청\(B010)수치지도_37705092_2022_00000597055733\N3L_F0010000.shp"
"C:\Users\BaekInchan\Desktop\설계스튜디오9_졸업설계\맵모델링\강남구청\(B010)수치지도_37705092_2022_00000597055733\N3L_F0040000.shp"
"C:\Users\BaekInchan\Desktop\설계스튜디오9_졸업설계\맵모델링\강남구청\(B010)수치지도_37705092_2022_00000597055733\N3L_G0030000.shp"
"C:\Users\BaekInchan\Desktop\설계스튜디오9_졸업설계\맵모델링\강남구청\(B010)수치지도_37705092_2022_00000597055733\N3L_H0010000.shp"
"C:\Users\BaekInchan\Desktop\설계스튜디오9_졸업설계\맵모델링\강남구청\(B010)수치지도_37705092_2022_00000597055733\N3P_A0131122.shp"
"C:\Users\BaekInchan\Desktop\설계스튜디오9_졸업설계\맵모델링\강남구청\(B010)수치지도_37705092_2022_00000597055733\N3P_C0285311.shp"
"C:\Users\BaekInchan\Desktop\설계스튜디오9_졸업설계\맵모델링\강남구청\(B010)수치지도_37705092_2022_00000597055733\N3P_C0310000.shp"
"C:\Users\BaekInchan\Desktop\설계스튜디오9_졸업설계\맵모델링\강남구청\(B010)수치지도_37705092_2022_00000597055733\N3P_C0380000.shp"
"C:\Users\BaekInchan\Desktop\설계스튜디오9_졸업설계\맵모델링\강남구청\(B010)수치지도_37705092_2022_00000597055733\N3P_F0020000.shp"
""")
panel_4 = Panel(""""C:\Users\BaekInchan\Desktop\설계스튜디오9_졸업설계\맵모델링\논현역\(B010)수치지도_37705091_2022_00000452529185\N3P_H0040000.shp"
"C:\Users\BaekInchan\Desktop\설계스튜디오9_졸업설계\맵모델링\논현역\(B010)수치지도_37705091_2022_00000452529185\N3A_A0010000.shp"
"C:\Users\BaekInchan\Desktop\설계스튜디오9_졸업설계\맵모델링\논현역\(B010)수치지도_37705091_2022_00000452529185\N3A_A0033320.shp"
"C:\Users\BaekInchan\Desktop\설계스튜디오9_졸업설계\맵모델링\논현역\(B010)수치지도_37705091_2022_00000452529185\N3A_A0053326.shp"
"C:\Users\BaekInchan\Desktop\설계스튜디오9_졸업설계\맵모델링\논현역\(B010)수치지도_37705091_2022_00000452529185\N3A_A0063321.shp"
"C:\Users\BaekInchan\Desktop\설계스튜디오9_졸업설계\맵모델링\논현역\(B010)수치지도_37705091_2022_00000452529185\N3A_A0070000.shp"
"C:\Users\BaekInchan\Desktop\설계스튜디오9_졸업설계\맵모델링\논현역\(B010)수치지도_37705091_2022_00000452529185\N3A_A0080000.shp"
"C:\Users\BaekInchan\Desktop\설계스튜디오9_졸업설계\맵모델링\논현역\(B010)수치지도_37705091_2022_00000452529185\N3A_A0090000.shp"
"C:\Users\BaekInchan\Desktop\설계스튜디오9_졸업설계\맵모델링\논현역\(B010)수치지도_37705091_2022_00000452529185\N3A_A0100000.shp"
"C:\Users\BaekInchan\Desktop\설계스튜디오9_졸업설계\맵모델링\논현역\(B010)수치지도_37705091_2022_00000452529185\N3A_A0160024.shp"
"C:\Users\BaekInchan\Desktop\설계스튜디오9_졸업설계\맵모델링\논현역\(B010)수치지도_37705091_2022_00000452529185\N3A_B0010000.shp"
"C:\Users\BaekInchan\Desktop\설계스튜디오9_졸업설계\맵모델링\논현역\(B010)수치지도_37705091_2022_00000452529185\N3A_C0186115.shp"
"C:\Users\BaekInchan\Desktop\설계스튜디오9_졸업설계\맵모델링\논현역\(B010)수치지도_37705091_2022_00000452529185\N3A_C0390000.shp"
"C:\Users\BaekInchan\Desktop\설계스튜디오9_졸업설계\맵모델링\논현역\(B010)수치지도_37705091_2022_00000452529185\N3A_C0423365.shp"
"C:\Users\BaekInchan\Desktop\설계스튜디오9_졸업설계\맵모델링\논현역\(B010)수치지도_37705091_2022_00000452529185\N3A_C0430000.shp"
"C:\Users\BaekInchan\Desktop\설계스튜디오9_졸업설계\맵모델링\논현역\(B010)수치지도_37705091_2022_00000452529185\N3A_D0010000.shp"
"C:\Users\BaekInchan\Desktop\설계스튜디오9_졸업설계\맵모델링\논현역\(B010)수치지도_37705091_2022_00000452529185\N3A_E0010001.shp"
"C:\Users\BaekInchan\Desktop\설계스튜디오9_졸업설계\맵모델링\논현역\(B010)수치지도_37705091_2022_00000452529185\N3A_E0032111.shp"
"C:\Users\BaekInchan\Desktop\설계스튜디오9_졸업설계\맵모델링\논현역\(B010)수치지도_37705091_2022_00000452529185\N3A_E0052114.shp"
"C:\Users\BaekInchan\Desktop\설계스튜디오9_졸업설계\맵모델링\논현역\(B010)수치지도_37705091_2022_00000452529185\N3A_G0010000.shp"
"C:\Users\BaekInchan\Desktop\설계스튜디오9_졸업설계\맵모델링\논현역\(B010)수치지도_37705091_2022_00000452529185\N3A_G0020000.shp"
"C:\Users\BaekInchan\Desktop\설계스튜디오9_졸업설계\맵모델링\논현역\(B010)수치지도_37705091_2022_00000452529185\N3L_A0010000.shp"
"C:\Users\BaekInchan\Desktop\설계스튜디오9_졸업설계\맵모델링\논현역\(B010)수치지도_37705091_2022_00000452529185\N3L_A0020000.shp"
"C:\Users\BaekInchan\Desktop\설계스튜디오9_졸업설계\맵모델링\논현역\(B010)수치지도_37705091_2022_00000452529185\N3L_A0033330.shp"
"C:\Users\BaekInchan\Desktop\설계스튜디오9_졸업설계\맵모델링\논현역\(B010)수치지도_37705091_2022_00000452529185\N3L_A0150000.shp"
"C:\Users\BaekInchan\Desktop\설계스튜디오9_졸업설계\맵모델링\논현역\(B010)수치지도_37705091_2022_00000452529185\N3L_A0171119.shp"
"C:\Users\BaekInchan\Desktop\설계스튜디오9_졸업설계\맵모델링\논현역\(B010)수치지도_37705091_2022_00000452529185\N3L_B0020000.shp"
"C:\Users\BaekInchan\Desktop\설계스튜디오9_졸업설계\맵모델링\논현역\(B010)수치지도_37705091_2022_00000452529185\N3L_C0050000.shp"
"C:\Users\BaekInchan\Desktop\설계스튜디오9_졸업설계\맵모델링\논현역\(B010)수치지도_37705091_2022_00000452529185\N3L_C0060000.shp"
"C:\Users\BaekInchan\Desktop\설계스튜디오9_졸업설계\맵모델링\논현역\(B010)수치지도_37705091_2022_00000452529185\N3L_C0070000.shp"
"C:\Users\BaekInchan\Desktop\설계스튜디오9_졸업설계\맵모델링\논현역\(B010)수치지도_37705091_2022_00000452529185\N3L_C0520000.shp"
"C:\Users\BaekInchan\Desktop\설계스튜디오9_졸업설계\맵모델링\논현역\(B010)수치지도_37705091_2022_00000452529185\N3L_E0020000.shp"
"C:\Users\BaekInchan\Desktop\설계스튜디오9_졸업설계\맵모델링\논현역\(B010)수치지도_37705091_2022_00000452529185\N3L_F0010000.shp"
"C:\Users\BaekInchan\Desktop\설계스튜디오9_졸업설계\맵모델링\논현역\(B010)수치지도_37705091_2022_00000452529185\N3L_F0030000.shp"
"C:\Users\BaekInchan\Desktop\설계스튜디오9_졸업설계\맵모델링\논현역\(B010)수치지도_37705091_2022_00000452529185\N3L_F0040000.shp"
"C:\Users\BaekInchan\Desktop\설계스튜디오9_졸업설계\맵모델링\논현역\(B010)수치지도_37705091_2022_00000452529185\N3L_G0030000.shp"
"C:\Users\BaekInchan\Desktop\설계스튜디오9_졸업설계\맵모델링\논현역\(B010)수치지도_37705091_2022_00000452529185\N3L_H0010000.shp"
"C:\Users\BaekInchan\Desktop\설계스튜디오9_졸업설계\맵모델링\논현역\(B010)수치지도_37705091_2022_00000452529185\N3P_A0131122.shp"
"C:\Users\BaekInchan\Desktop\설계스튜디오9_졸업설계\맵모델링\논현역\(B010)수치지도_37705091_2022_00000452529185\N3P_C0380000.shp"
"C:\Users\BaekInchan\Desktop\설계스튜디오9_졸업설계\맵모델링\논현역\(B010)수치지도_37705091_2022_00000452529185\N3P_D0030000.shp"
"C:\Users\BaekInchan\Desktop\설계스튜디오9_졸업설계\맵모델링\논현역\(B010)수치지도_37705091_2022_00000452529185\N3P_E0042326.shp"
"C:\Users\BaekInchan\Desktop\설계스튜디오9_졸업설계\맵모델링\논현역\(B010)수치지도_37705091_2022_00000452529185\N3P_F0020000.shp"
"C:\Users\BaekInchan\Desktop\설계스튜디오9_졸업설계\맵모델링\논현역\(B010)수치지도_37705091_2022_00000452529185\N3P_H0020000.shp"
""")
# 하천
panel_5 = Panel(""""C:\Users\BaekInchan\Desktop\설계스튜디오9_졸업설계\맵모델링\압구정\N3A_A0010000.shp"
"C:\Users\BaekInchan\Desktop\설계스튜디오9_졸업설계\맵모델링\압구정\N3A_A0033320.shp"
"C:\Users\BaekInchan\Desktop\설계스튜디오9_졸업설계\맵모델링\압구정\N3A_A0053326.shp"
"C:\Users\BaekInchan\Desktop\설계스튜디오9_졸업설계\맵모델링\압구정\N3A_A0063321.shp"
"C:\Users\BaekInchan\Desktop\설계스튜디오9_졸업설계\맵모델링\압구정\N3A_A0070000.shp"
"C:\Users\BaekInchan\Desktop\설계스튜디오9_졸업설계\맵모델링\압구정\N3A_A0080000.shp"
"C:\Users\BaekInchan\Desktop\설계스튜디오9_졸업설계\맵모델링\압구정\N3A_A0090000.shp"
"C:\Users\BaekInchan\Desktop\설계스튜디오9_졸업설계\맵모델링\압구정\N3A_A0100000.shp"
"C:\Users\BaekInchan\Desktop\설계스튜디오9_졸업설계\맵모델링\압구정\N3A_A0110020.shp"
"C:\Users\BaekInchan\Desktop\설계스튜디오9_졸업설계\맵모델링\압구정\N3A_A0160024.shp"
"C:\Users\BaekInchan\Desktop\설계스튜디오9_졸업설계\맵모델링\압구정\N3A_A0191221.shp"
"C:\Users\BaekInchan\Desktop\설계스튜디오9_졸업설계\맵모델링\압구정\N3A_A0201222.shp"
"C:\Users\BaekInchan\Desktop\설계스튜디오9_졸업설계\맵모델링\압구정\N3A_B0010000.shp"
"C:\Users\BaekInchan\Desktop\설계스튜디오9_졸업설계\맵모델링\압구정\N3A_C0186115.shp"
"C:\Users\BaekInchan\Desktop\설계스튜디오9_졸업설계\맵모델링\압구정\N3A_C0390000.shp"
"C:\Users\BaekInchan\Desktop\설계스튜디오9_졸업설계\맵모델링\압구정\N3A_C0423365.shp"
"C:\Users\BaekInchan\Desktop\설계스튜디오9_졸업설계\맵모델링\압구정\N3A_C0430000.shp"
"C:\Users\BaekInchan\Desktop\설계스튜디오9_졸업설계\맵모델링\압구정\N3A_D0010000.shp"
"C:\Users\BaekInchan\Desktop\설계스튜디오9_졸업설계\맵모델링\압구정\N3A_E0010001.shp"
"C:\Users\BaekInchan\Desktop\설계스튜디오9_졸업설계\맵모델링\압구정\N3A_E0032111.shp"
"C:\Users\BaekInchan\Desktop\설계스튜디오9_졸업설계\맵모델링\압구정\N3A_E0052114.shp"
"C:\Users\BaekInchan\Desktop\설계스튜디오9_졸업설계\맵모델링\압구정\N3A_G0010000.shp"
"C:\Users\BaekInchan\Desktop\설계스튜디오9_졸업설계\맵모델링\압구정\N3A_G0020000.shp"
"C:\Users\BaekInchan\Desktop\설계스튜디오9_졸업설계\맵모델링\압구정\N3L_A0010000.shp"
"C:\Users\BaekInchan\Desktop\설계스튜디오9_졸업설계\맵모델링\압구정\N3L_A0020000.shp"
"C:\Users\BaekInchan\Desktop\설계스튜디오9_졸업설계\맵모델링\압구정\N3L_A0033330.shp"
"C:\Users\BaekInchan\Desktop\설계스튜디오9_졸업설계\맵모델링\압구정\N3L_A0123373.shp"
"C:\Users\BaekInchan\Desktop\설계스튜디오9_졸업설계\맵모델링\압구정\N3L_A0150000.shp"
"C:\Users\BaekInchan\Desktop\설계스튜디오9_졸업설계\맵모델링\압구정\N3L_A0171119.shp"
"C:\Users\BaekInchan\Desktop\설계스튜디오9_졸업설계\맵모델링\압구정\N3L_B0020000.shp"
"C:\Users\BaekInchan\Desktop\설계스튜디오9_졸업설계\맵모델링\압구정\N3L_C0050000.shp"
"C:\Users\BaekInchan\Desktop\설계스튜디오9_졸업설계\맵모델링\압구정\N3L_C0060000.shp"
"C:\Users\BaekInchan\Desktop\설계스튜디오9_졸업설계\맵모델링\압구정\N3L_C0070000.shp"
"C:\Users\BaekInchan\Desktop\설계스튜디오9_졸업설계\맵모델링\압구정\N3L_C0520000.shp"
"C:\Users\BaekInchan\Desktop\설계스튜디오9_졸업설계\맵모델링\압구정\N3L_E0020000.shp"
"C:\Users\BaekInchan\Desktop\설계스튜디오9_졸업설계\맵모델링\압구정\N3L_F0010000.shp"
"C:\Users\BaekInchan\Desktop\설계스튜디오9_졸업설계\맵모델링\압구정\N3L_F0030000.shp"
"C:\Users\BaekInchan\Desktop\설계스튜디오9_졸업설계\맵모델링\압구정\N3L_F0040000.shp"
"C:\Users\BaekInchan\Desktop\설계스튜디오9_졸업설계\맵모델링\압구정\N3L_G0030000.shp"
"C:\Users\BaekInchan\Desktop\설계스튜디오9_졸업설계\맵모델링\압구정\N3L_H0010000.shp"
"C:\Users\BaekInchan\Desktop\설계스튜디오9_졸업설계\맵모델링\압구정\N3P_A0131122.shp"
"C:\Users\BaekInchan\Desktop\설계스튜디오9_졸업설계\맵모델링\압구정\N3P_C0210000.shp"
"C:\Users\BaekInchan\Desktop\설계스튜디오9_졸업설계\맵모델링\압구정\N3P_C0380000.shp"
"C:\Users\BaekInchan\Desktop\설계스튜디오9_졸업설계\맵모델링\압구정\N3P_D0030000.shp"
"C:\Users\BaekInchan\Desktop\설계스튜디오9_졸업설계\맵모델링\압구정\N3P_E0042326.shp"
"C:\Users\BaekInchan\Desktop\설계스튜디오9_졸업설계\맵모델링\압구정\N3P_F0020000.shp"
"C:\Users\BaekInchan\Desktop\설계스튜디오9_졸업설계\맵모델링\압구정\N3P_H0020000.shp"
"C:\Users\BaekInchan\Desktop\설계스튜디오9_졸업설계\맵모델링\압구정\N3P_H0040000.shp"
"C:\Users\BaekInchan\Desktop\설계스튜디오9_졸업설계\맵모델링\압구정\N3P_H0059153.shp"
""")  # disabled
panel_6 = Panel(""""C:\Users\BaekInchan\Desktop\설계스튜디오9_졸업설계\맵모델링\신사\N3P_H0059153.shp"
"C:\Users\BaekInchan\Desktop\설계스튜디오9_졸업설계\맵모델링\신사\N3A_A0010000.shp"
"C:\Users\BaekInchan\Desktop\설계스튜디오9_졸업설계\맵모델링\신사\N3A_A0033320.shp"
"C:\Users\BaekInchan\Desktop\설계스튜디오9_졸업설계\맵모델링\신사\N3A_A0053326.shp"
"C:\Users\BaekInchan\Desktop\설계스튜디오9_졸업설계\맵모델링\신사\N3A_A0063321.shp"
"C:\Users\BaekInchan\Desktop\설계스튜디오9_졸업설계\맵모델링\신사\N3A_A0070000.shp"
"C:\Users\BaekInchan\Desktop\설계스튜디오9_졸업설계\맵모델링\신사\N3A_A0080000.shp"
"C:\Users\BaekInchan\Desktop\설계스튜디오9_졸업설계\맵모델링\신사\N3A_A0090000.shp"
"C:\Users\BaekInchan\Desktop\설계스튜디오9_졸업설계\맵모델링\신사\N3A_A0100000.shp"
"C:\Users\BaekInchan\Desktop\설계스튜디오9_졸업설계\맵모델링\신사\N3A_A0110020.shp"
"C:\Users\BaekInchan\Desktop\설계스튜디오9_졸업설계\맵모델링\신사\N3A_A0160024.shp"
"C:\Users\BaekInchan\Desktop\설계스튜디오9_졸업설계\맵모델링\신사\N3A_A0191221.shp"
"C:\Users\BaekInchan\Desktop\설계스튜디오9_졸업설계\맵모델링\신사\N3A_A0201222.shp"
"C:\Users\BaekInchan\Desktop\설계스튜디오9_졸업설계\맵모델링\신사\N3A_B0010000.shp"
"C:\Users\BaekInchan\Desktop\설계스튜디오9_졸업설계\맵모델링\신사\N3A_C0186115.shp"
"C:\Users\BaekInchan\Desktop\설계스튜디오9_졸업설계\맵모델링\신사\N3A_C0390000.shp"
"C:\Users\BaekInchan\Desktop\설계스튜디오9_졸업설계\맵모델링\신사\N3A_C0423365.shp"
"C:\Users\BaekInchan\Desktop\설계스튜디오9_졸업설계\맵모델링\신사\N3A_C0430000.shp"
"C:\Users\BaekInchan\Desktop\설계스튜디오9_졸업설계\맵모델링\신사\N3A_D0010000.shp"
"C:\Users\BaekInchan\Desktop\설계스튜디오9_졸업설계\맵모델링\신사\N3A_E0010001.shp"
"C:\Users\BaekInchan\Desktop\설계스튜디오9_졸업설계\맵모델링\신사\N3A_E0032111.shp"
"C:\Users\BaekInchan\Desktop\설계스튜디오9_졸업설계\맵모델링\신사\N3A_E0052114.shp"
"C:\Users\BaekInchan\Desktop\설계스튜디오9_졸업설계\맵모델링\신사\N3A_G0010000.shp"
"C:\Users\BaekInchan\Desktop\설계스튜디오9_졸업설계\맵모델링\신사\N3A_G0020000.shp"
"C:\Users\BaekInchan\Desktop\설계스튜디오9_졸업설계\맵모델링\신사\N3L_A0010000.shp"
"C:\Users\BaekInchan\Desktop\설계스튜디오9_졸업설계\맵모델링\신사\N3L_A0020000.shp"
"C:\Users\BaekInchan\Desktop\설계스튜디오9_졸업설계\맵모델링\신사\N3L_A0033320.shp"
"C:\Users\BaekInchan\Desktop\설계스튜디오9_졸업설계\맵모델링\신사\N3L_A0123373.shp"
"C:\Users\BaekInchan\Desktop\설계스튜디오9_졸업설계\맵모델링\신사\N3L_A0150000.shp"
"C:\Users\BaekInchan\Desktop\설계스튜디오9_졸업설계\맵모델링\신사\N3L_A0171119.shp"
"C:\Users\BaekInchan\Desktop\설계스튜디오9_졸업설계\맵모델링\신사\N3L_B0020000.shp"
"C:\Users\BaekInchan\Desktop\설계스튜디오9_졸업설계\맵모델링\신사\N3L_C0050000.shp"
"C:\Users\BaekInchan\Desktop\설계스튜디오9_졸업설계\맵모델링\신사\N3L_C0060000.shp"
"C:\Users\BaekInchan\Desktop\설계스튜디오9_졸업설계\맵모델링\신사\N3L_C0520000.shp"
"C:\Users\BaekInchan\Desktop\설계스튜디오9_졸업설계\맵모델링\신사\N3L_E0020000.shp"
"C:\Users\BaekInchan\Desktop\설계스튜디오9_졸업설계\맵모델링\신사\N3L_F0010000.shp"
"C:\Users\BaekInchan\Desktop\설계스튜디오9_졸업설계\맵모델링\신사\N3L_F0030000.shp"
"C:\Users\BaekInchan\Desktop\설계스튜디오9_졸업설계\맵모델링\신사\N3L_F0040000.shp"
"C:\Users\BaekInchan\Desktop\설계스튜디오9_졸업설계\맵모델링\신사\N3L_G0030000.shp"
"C:\Users\BaekInchan\Desktop\설계스튜디오9_졸업설계\맵모델링\신사\N3L_H0010000.shp"
"C:\Users\BaekInchan\Desktop\설계스튜디오9_졸업설계\맵모델링\신사\N3P_A0131122.shp"
"C:\Users\BaekInchan\Desktop\설계스튜디오9_졸업설계\맵모델링\신사\N3P_C0380000.shp"
"C:\Users\BaekInchan\Desktop\설계스튜디오9_졸업설계\맵모델링\신사\N3P_E0042326.shp"
"C:\Users\BaekInchan\Desktop\설계스튜디오9_졸업설계\맵모델링\신사\N3P_F0020000.shp"
"C:\Users\BaekInchan\Desktop\설계스튜디오9_졸업설계\맵모델링\신사\N3P_H0020000.shp"
"C:\Users\BaekInchan\Desktop\설계스튜디오9_졸업설계\맵모델링\신사\N3P_H0040000.shp"
""")  # disabled
panel_7 = Panel(""""C:\Users\BaekInchan\Desktop\설계스튜디오9_졸업설계\맵모델링\강남구청\(B010)수치지도_37705092_2022_00000597055733\N3P_H0040000.shp"
"C:\Users\BaekInchan\Desktop\설계스튜디오9_졸업설계\맵모델링\강남구청\(B010)수치지도_37705092_2022_00000597055733\N3A_A0010000.shp"
"C:\Users\BaekInchan\Desktop\설계스튜디오9_졸업설계\맵모델링\강남구청\(B010)수치지도_37705092_2022_00000597055733\N3A_A0033320.shp"
"C:\Users\BaekInchan\Desktop\설계스튜디오9_졸업설계\맵모델링\강남구청\(B010)수치지도_37705092_2022_00000597055733\N3A_A0053326.shp"
"C:\Users\BaekInchan\Desktop\설계스튜디오9_졸업설계\맵모델링\강남구청\(B010)수치지도_37705092_2022_00000597055733\N3A_A0080000.shp"
"C:\Users\BaekInchan\Desktop\설계스튜디오9_졸업설계\맵모델링\강남구청\(B010)수치지도_37705092_2022_00000597055733\N3A_B0010000.shp"
"C:\Users\BaekInchan\Desktop\설계스튜디오9_졸업설계\맵모델링\강남구청\(B010)수치지도_37705092_2022_00000597055733\N3A_C0186115.shp"
"C:\Users\BaekInchan\Desktop\설계스튜디오9_졸업설계\맵모델링\강남구청\(B010)수치지도_37705092_2022_00000597055733\N3A_C0305316.shp"
"C:\Users\BaekInchan\Desktop\설계스튜디오9_졸업설계\맵모델링\강남구청\(B010)수치지도_37705092_2022_00000597055733\N3A_C0390000.shp"
"C:\Users\BaekInchan\Desktop\설계스튜디오9_졸업설계\맵모델링\강남구청\(B010)수치지도_37705092_2022_00000597055733\N3A_C0423365.shp"
"C:\Users\BaekInchan\Desktop\설계스튜디오9_졸업설계\맵모델링\강남구청\(B010)수치지도_37705092_2022_00000597055733\N3A_C0430000.shp"
"C:\Users\BaekInchan\Desktop\설계스튜디오9_졸업설계\맵모델링\강남구청\(B010)수치지도_37705092_2022_00000597055733\N3A_G0010000.shp"
"C:\Users\BaekInchan\Desktop\설계스튜디오9_졸업설계\맵모델링\강남구청\(B010)수치지도_37705092_2022_00000597055733\N3L_A0010000.shp"
"C:\Users\BaekInchan\Desktop\설계스튜디오9_졸업설계\맵모델링\강남구청\(B010)수치지도_37705092_2022_00000597055733\N3L_A0020000.shp"
"C:\Users\BaekInchan\Desktop\설계스튜디오9_졸업설계\맵모델링\강남구청\(B010)수치지도_37705092_2022_00000597055733\N3L_A0033330.shp"
"C:\Users\BaekInchan\Desktop\설계스튜디오9_졸업설계\맵모델링\강남구청\(B010)수치지도_37705092_2022_00000597055733\N3L_B0020000.shp"
"C:\Users\BaekInchan\Desktop\설계스튜디오9_졸업설계\맵모델링\강남구청\(B010)수치지도_37705092_2022_00000597055733\N3L_C0070000.shp"
"C:\Users\BaekInchan\Desktop\설계스튜디오9_졸업설계\맵모델링\강남구청\(B010)수치지도_37705092_2022_00000597055733\N3L_C0520000.shp"
"C:\Users\BaekInchan\Desktop\설계스튜디오9_졸업설계\맵모델링\강남구청\(B010)수치지도_37705092_2022_00000597055733\N3L_E0020000.shp"
"C:\Users\BaekInchan\Desktop\설계스튜디오9_졸업설계\맵모델링\강남구청\(B010)수치지도_37705092_2022_00000597055733\N3L_F0010000.shp"
"C:\Users\BaekInchan\Desktop\설계스튜디오9_졸업설계\맵모델링\강남구청\(B010)수치지도_37705092_2022_00000597055733\N3L_F0040000.shp"
"C:\Users\BaekInchan\Desktop\설계스튜디오9_졸업설계\맵모델링\강남구청\(B010)수치지도_37705092_2022_00000597055733\N3L_G0030000.shp"
"C:\Users\BaekInchan\Desktop\설계스튜디오9_졸업설계\맵모델링\강남구청\(B010)수치지도_37705092_2022_00000597055733\N3L_H0010000.shp"
"C:\Users\BaekInchan\Desktop\설계스튜디오9_졸업설계\맵모델링\강남구청\(B010)수치지도_37705092_2022_00000597055733\N3P_A0131122.shp"
"C:\Users\BaekInchan\Desktop\설계스튜디오9_졸업설계\맵모델링\강남구청\(B010)수치지도_37705092_2022_00000597055733\N3P_C0285311.shp"
"C:\Users\BaekInchan\Desktop\설계스튜디오9_졸업설계\맵모델링\강남구청\(B010)수치지도_37705092_2022_00000597055733\N3P_C0310000.shp"
"C:\Users\BaekInchan\Desktop\설계스튜디오9_졸업설계\맵모델링\강남구청\(B010)수치지도_37705092_2022_00000597055733\N3P_C0380000.shp"
"C:\Users\BaekInchan\Desktop\설계스튜디오9_졸업설계\맵모델링\강남구청\(B010)수치지도_37705092_2022_00000597055733\N3P_F0020000.shp"
""")  # disabled
panel_8 = Panel(""""C:\Users\BaekInchan\Desktop\설계스튜디오9_졸업설계\맵모델링\논현역\(B010)수치지도_37705091_2022_00000452529185\N3P_H0040000.shp"
"C:\Users\BaekInchan\Desktop\설계스튜디오9_졸업설계\맵모델링\논현역\(B010)수치지도_37705091_2022_00000452529185\N3A_A0010000.shp"
"C:\Users\BaekInchan\Desktop\설계스튜디오9_졸업설계\맵모델링\논현역\(B010)수치지도_37705091_2022_00000452529185\N3A_A0033320.shp"
"C:\Users\BaekInchan\Desktop\설계스튜디오9_졸업설계\맵모델링\논현역\(B010)수치지도_37705091_2022_00000452529185\N3A_A0053326.shp"
"C:\Users\BaekInchan\Desktop\설계스튜디오9_졸업설계\맵모델링\논현역\(B010)수치지도_37705091_2022_00000452529185\N3A_A0063321.shp"
"C:\Users\BaekInchan\Desktop\설계스튜디오9_졸업설계\맵모델링\논현역\(B010)수치지도_37705091_2022_00000452529185\N3A_A0070000.shp"
"C:\Users\BaekInchan\Desktop\설계스튜디오9_졸업설계\맵모델링\논현역\(B010)수치지도_37705091_2022_00000452529185\N3A_A0080000.shp"
"C:\Users\BaekInchan\Desktop\설계스튜디오9_졸업설계\맵모델링\논현역\(B010)수치지도_37705091_2022_00000452529185\N3A_A0090000.shp"
"C:\Users\BaekInchan\Desktop\설계스튜디오9_졸업설계\맵모델링\논현역\(B010)수치지도_37705091_2022_00000452529185\N3A_A0100000.shp"
"C:\Users\BaekInchan\Desktop\설계스튜디오9_졸업설계\맵모델링\논현역\(B010)수치지도_37705091_2022_00000452529185\N3A_A0160024.shp"
"C:\Users\BaekInchan\Desktop\설계스튜디오9_졸업설계\맵모델링\논현역\(B010)수치지도_37705091_2022_00000452529185\N3A_B0010000.shp"
"C:\Users\BaekInchan\Desktop\설계스튜디오9_졸업설계\맵모델링\논현역\(B010)수치지도_37705091_2022_00000452529185\N3A_C0186115.shp"
"C:\Users\BaekInchan\Desktop\설계스튜디오9_졸업설계\맵모델링\논현역\(B010)수치지도_37705091_2022_00000452529185\N3A_C0390000.shp"
"C:\Users\BaekInchan\Desktop\설계스튜디오9_졸업설계\맵모델링\논현역\(B010)수치지도_37705091_2022_00000452529185\N3A_C0423365.shp"
"C:\Users\BaekInchan\Desktop\설계스튜디오9_졸업설계\맵모델링\논현역\(B010)수치지도_37705091_2022_00000452529185\N3A_C0430000.shp"
"C:\Users\BaekInchan\Desktop\설계스튜디오9_졸업설계\맵모델링\논현역\(B010)수치지도_37705091_2022_00000452529185\N3A_D0010000.shp"
"C:\Users\BaekInchan\Desktop\설계스튜디오9_졸업설계\맵모델링\논현역\(B010)수치지도_37705091_2022_00000452529185\N3A_E0010001.shp"
"C:\Users\BaekInchan\Desktop\설계스튜디오9_졸업설계\맵모델링\논현역\(B010)수치지도_37705091_2022_00000452529185\N3A_E0032111.shp"
"C:\Users\BaekInchan\Desktop\설계스튜디오9_졸업설계\맵모델링\논현역\(B010)수치지도_37705091_2022_00000452529185\N3A_E0052114.shp"
"C:\Users\BaekInchan\Desktop\설계스튜디오9_졸업설계\맵모델링\논현역\(B010)수치지도_37705091_2022_00000452529185\N3A_G0010000.shp"
"C:\Users\BaekInchan\Desktop\설계스튜디오9_졸업설계\맵모델링\논현역\(B010)수치지도_37705091_2022_00000452529185\N3A_G0020000.shp"
"C:\Users\BaekInchan\Desktop\설계스튜디오9_졸업설계\맵모델링\논현역\(B010)수치지도_37705091_2022_00000452529185\N3L_A0010000.shp"
"C:\Users\BaekInchan\Desktop\설계스튜디오9_졸업설계\맵모델링\논현역\(B010)수치지도_37705091_2022_00000452529185\N3L_A0020000.shp"
"C:\Users\BaekInchan\Desktop\설계스튜디오9_졸업설계\맵모델링\논현역\(B010)수치지도_37705091_2022_00000452529185\N3L_A0033330.shp"
"C:\Users\BaekInchan\Desktop\설계스튜디오9_졸업설계\맵모델링\논현역\(B010)수치지도_37705091_2022_00000452529185\N3L_A0150000.shp"
"C:\Users\BaekInchan\Desktop\설계스튜디오9_졸업설계\맵모델링\논현역\(B010)수치지도_37705091_2022_00000452529185\N3L_A0171119.shp"
"C:\Users\BaekInchan\Desktop\설계스튜디오9_졸업설계\맵모델링\논현역\(B010)수치지도_37705091_2022_00000452529185\N3L_B0020000.shp"
"C:\Users\BaekInchan\Desktop\설계스튜디오9_졸업설계\맵모델링\논현역\(B010)수치지도_37705091_2022_00000452529185\N3L_C0050000.shp"
"C:\Users\BaekInchan\Desktop\설계스튜디오9_졸업설계\맵모델링\논현역\(B010)수치지도_37705091_2022_00000452529185\N3L_C0060000.shp"
"C:\Users\BaekInchan\Desktop\설계스튜디오9_졸업설계\맵모델링\논현역\(B010)수치지도_37705091_2022_00000452529185\N3L_C0070000.shp"
"C:\Users\BaekInchan\Desktop\설계스튜디오9_졸업설계\맵모델링\논현역\(B010)수치지도_37705091_2022_00000452529185\N3L_C0520000.shp"
"C:\Users\BaekInchan\Desktop\설계스튜디오9_졸업설계\맵모델링\논현역\(B010)수치지도_37705091_2022_00000452529185\N3L_E0020000.shp"
"C:\Users\BaekInchan\Desktop\설계스튜디오9_졸업설계\맵모델링\논현역\(B010)수치지도_37705091_2022_00000452529185\N3L_F0010000.shp"
"C:\Users\BaekInchan\Desktop\설계스튜디오9_졸업설계\맵모델링\논현역\(B010)수치지도_37705091_2022_00000452529185\N3L_F0030000.shp"
"C:\Users\BaekInchan\Desktop\설계스튜디오9_졸업설계\맵모델링\논현역\(B010)수치지도_37705091_2022_00000452529185\N3L_F0040000.shp"
"C:\Users\BaekInchan\Desktop\설계스튜디오9_졸업설계\맵모델링\논현역\(B010)수치지도_37705091_2022_00000452529185\N3L_G0030000.shp"
"C:\Users\BaekInchan\Desktop\설계스튜디오9_졸업설계\맵모델링\논현역\(B010)수치지도_37705091_2022_00000452529185\N3L_H0010000.shp"
"C:\Users\BaekInchan\Desktop\설계스튜디오9_졸업설계\맵모델링\논현역\(B010)수치지도_37705091_2022_00000452529185\N3P_A0131122.shp"
"C:\Users\BaekInchan\Desktop\설계스튜디오9_졸업설계\맵모델링\논현역\(B010)수치지도_37705091_2022_00000452529185\N3P_C0380000.shp"
"C:\Users\BaekInchan\Desktop\설계스튜디오9_졸업설계\맵모델링\논현역\(B010)수치지도_37705091_2022_00000452529185\N3P_D0030000.shp"
"C:\Users\BaekInchan\Desktop\설계스튜디오9_졸업설계\맵모델링\논현역\(B010)수치지도_37705091_2022_00000452529185\N3P_E0042326.shp"
"C:\Users\BaekInchan\Desktop\설계스튜디오9_졸업설계\맵모델링\논현역\(B010)수치지도_37705091_2022_00000452529185\N3P_F0020000.shp"
"C:\Users\BaekInchan\Desktop\설계스튜디오9_졸업설계\맵모델링\논현역\(B010)수치지도_37705091_2022_00000452529185\N3P_H0020000.shp"
""")  # disabled
# 자동차 전용
panel_9 = Panel(""""C:\Users\BaekInchan\Desktop\설계스튜디오9_졸업설계\맵모델링\압구정\N3A_A0010000.shp"
"C:\Users\BaekInchan\Desktop\설계스튜디오9_졸업설계\맵모델링\압구정\N3A_A0033320.shp"
"C:\Users\BaekInchan\Desktop\설계스튜디오9_졸업설계\맵모델링\압구정\N3A_A0053326.shp"
"C:\Users\BaekInchan\Desktop\설계스튜디오9_졸업설계\맵모델링\압구정\N3A_A0063321.shp"
"C:\Users\BaekInchan\Desktop\설계스튜디오9_졸업설계\맵모델링\압구정\N3A_A0070000.shp"
"C:\Users\BaekInchan\Desktop\설계스튜디오9_졸업설계\맵모델링\압구정\N3A_A0080000.shp"
"C:\Users\BaekInchan\Desktop\설계스튜디오9_졸업설계\맵모델링\압구정\N3A_A0090000.shp"
"C:\Users\BaekInchan\Desktop\설계스튜디오9_졸업설계\맵모델링\압구정\N3A_A0100000.shp"
"C:\Users\BaekInchan\Desktop\설계스튜디오9_졸업설계\맵모델링\압구정\N3A_A0110020.shp"
"C:\Users\BaekInchan\Desktop\설계스튜디오9_졸업설계\맵모델링\압구정\N3A_A0160024.shp"
"C:\Users\BaekInchan\Desktop\설계스튜디오9_졸업설계\맵모델링\압구정\N3A_A0191221.shp"
"C:\Users\BaekInchan\Desktop\설계스튜디오9_졸업설계\맵모델링\압구정\N3A_A0201222.shp"
"C:\Users\BaekInchan\Desktop\설계스튜디오9_졸업설계\맵모델링\압구정\N3A_B0010000.shp"
"C:\Users\BaekInchan\Desktop\설계스튜디오9_졸업설계\맵모델링\압구정\N3A_C0186115.shp"
"C:\Users\BaekInchan\Desktop\설계스튜디오9_졸업설계\맵모델링\압구정\N3A_C0390000.shp"
"C:\Users\BaekInchan\Desktop\설계스튜디오9_졸업설계\맵모델링\압구정\N3A_C0423365.shp"
"C:\Users\BaekInchan\Desktop\설계스튜디오9_졸업설계\맵모델링\압구정\N3A_C0430000.shp"
"C:\Users\BaekInchan\Desktop\설계스튜디오9_졸업설계\맵모델링\압구정\N3A_D0010000.shp"
"C:\Users\BaekInchan\Desktop\설계스튜디오9_졸업설계\맵모델링\압구정\N3A_E0010001.shp"
"C:\Users\BaekInchan\Desktop\설계스튜디오9_졸업설계\맵모델링\압구정\N3A_E0032111.shp"
"C:\Users\BaekInchan\Desktop\설계스튜디오9_졸업설계\맵모델링\압구정\N3A_E0052114.shp"
"C:\Users\BaekInchan\Desktop\설계스튜디오9_졸업설계\맵모델링\압구정\N3A_G0010000.shp"
"C:\Users\BaekInchan\Desktop\설계스튜디오9_졸업설계\맵모델링\압구정\N3A_G0020000.shp"
"C:\Users\BaekInchan\Desktop\설계스튜디오9_졸업설계\맵모델링\압구정\N3L_A0010000.shp"
"C:\Users\BaekInchan\Desktop\설계스튜디오9_졸업설계\맵모델링\압구정\N3L_A0020000.shp"
"C:\Users\BaekInchan\Desktop\설계스튜디오9_졸업설계\맵모델링\압구정\N3L_A0033330.shp"
"C:\Users\BaekInchan\Desktop\설계스튜디오9_졸업설계\맵모델링\압구정\N3L_A0123373.shp"
"C:\Users\BaekInchan\Desktop\설계스튜디오9_졸업설계\맵모델링\압구정\N3L_A0150000.shp"
"C:\Users\BaekInchan\Desktop\설계스튜디오9_졸업설계\맵모델링\압구정\N3L_A0171119.shp"
"C:\Users\BaekInchan\Desktop\설계스튜디오9_졸업설계\맵모델링\압구정\N3L_B0020000.shp"
"C:\Users\BaekInchan\Desktop\설계스튜디오9_졸업설계\맵모델링\압구정\N3L_C0050000.shp"
"C:\Users\BaekInchan\Desktop\설계스튜디오9_졸업설계\맵모델링\압구정\N3L_C0060000.shp"
"C:\Users\BaekInchan\Desktop\설계스튜디오9_졸업설계\맵모델링\압구정\N3L_C0070000.shp"
"C:\Users\BaekInchan\Desktop\설계스튜디오9_졸업설계\맵모델링\압구정\N3L_C0520000.shp"
"C:\Users\BaekInchan\Desktop\설계스튜디오9_졸업설계\맵모델링\압구정\N3L_E0020000.shp"
"C:\Users\BaekInchan\Desktop\설계스튜디오9_졸업설계\맵모델링\압구정\N3L_F0010000.shp"
"C:\Users\BaekInchan\Desktop\설계스튜디오9_졸업설계\맵모델링\압구정\N3L_F0030000.shp"
"C:\Users\BaekInchan\Desktop\설계스튜디오9_졸업설계\맵모델링\압구정\N3L_F0040000.shp"
"C:\Users\BaekInchan\Desktop\설계스튜디오9_졸업설계\맵모델링\압구정\N3L_G0030000.shp"
"C:\Users\BaekInchan\Desktop\설계스튜디오9_졸업설계\맵모델링\압구정\N3L_H0010000.shp"
"C:\Users\BaekInchan\Desktop\설계스튜디오9_졸업설계\맵모델링\압구정\N3P_A0131122.shp"
"C:\Users\BaekInchan\Desktop\설계스튜디오9_졸업설계\맵모델링\압구정\N3P_C0210000.shp"
"C:\Users\BaekInchan\Desktop\설계스튜디오9_졸업설계\맵모델링\압구정\N3P_C0380000.shp"
"C:\Users\BaekInchan\Desktop\설계스튜디오9_졸업설계\맵모델링\압구정\N3P_D0030000.shp"
"C:\Users\BaekInchan\Desktop\설계스튜디오9_졸업설계\맵모델링\압구정\N3P_E0042326.shp"
"C:\Users\BaekInchan\Desktop\설계스튜디오9_졸업설계\맵모델링\압구정\N3P_F0020000.shp"
"C:\Users\BaekInchan\Desktop\설계스튜디오9_졸업설계\맵모델링\압구정\N3P_H0020000.shp"
"C:\Users\BaekInchan\Desktop\설계스튜디오9_졸업설계\맵모델링\압구정\N3P_H0040000.shp"
"C:\Users\BaekInchan\Desktop\설계스튜디오9_졸업설계\맵모델링\압구정\N3P_H0059153.shp"
""")
panel_10 = Panel(""""C:\Users\BaekInchan\Desktop\설계스튜디오9_졸업설계\맵모델링\강남구청\(B010)수치지도_37705092_2022_00000597055733\N3P_H0040000.shp"
"C:\Users\BaekInchan\Desktop\설계스튜디오9_졸업설계\맵모델링\강남구청\(B010)수치지도_37705092_2022_00000597055733\N3A_A0010000.shp"
"C:\Users\BaekInchan\Desktop\설계스튜디오9_졸업설계\맵모델링\강남구청\(B010)수치지도_37705092_2022_00000597055733\N3A_A0033320.shp"
"C:\Users\BaekInchan\Desktop\설계스튜디오9_졸업설계\맵모델링\강남구청\(B010)수치지도_37705092_2022_00000597055733\N3A_A0053326.shp"
"C:\Users\BaekInchan\Desktop\설계스튜디오9_졸업설계\맵모델링\강남구청\(B010)수치지도_37705092_2022_00000597055733\N3A_A0080000.shp"
"C:\Users\BaekInchan\Desktop\설계스튜디오9_졸업설계\맵모델링\강남구청\(B010)수치지도_37705092_2022_00000597055733\N3A_B0010000.shp"
"C:\Users\BaekInchan\Desktop\설계스튜디오9_졸업설계\맵모델링\강남구청\(B010)수치지도_37705092_2022_00000597055733\N3A_C0186115.shp"
"C:\Users\BaekInchan\Desktop\설계스튜디오9_졸업설계\맵모델링\강남구청\(B010)수치지도_37705092_2022_00000597055733\N3A_C0305316.shp"
"C:\Users\BaekInchan\Desktop\설계스튜디오9_졸업설계\맵모델링\강남구청\(B010)수치지도_37705092_2022_00000597055733\N3A_C0390000.shp"
"C:\Users\BaekInchan\Desktop\설계스튜디오9_졸업설계\맵모델링\강남구청\(B010)수치지도_37705092_2022_00000597055733\N3A_C0423365.shp"
"C:\Users\BaekInchan\Desktop\설계스튜디오9_졸업설계\맵모델링\강남구청\(B010)수치지도_37705092_2022_00000597055733\N3A_C0430000.shp"
"C:\Users\BaekInchan\Desktop\설계스튜디오9_졸업설계\맵모델링\강남구청\(B010)수치지도_37705092_2022_00000597055733\N3A_G0010000.shp"
"C:\Users\BaekInchan\Desktop\설계스튜디오9_졸업설계\맵모델링\강남구청\(B010)수치지도_37705092_2022_00000597055733\N3L_A0010000.shp"
"C:\Users\BaekInchan\Desktop\설계스튜디오9_졸업설계\맵모델링\강남구청\(B010)수치지도_37705092_2022_00000597055733\N3L_A0020000.shp"
"C:\Users\BaekInchan\Desktop\설계스튜디오9_졸업설계\맵모델링\강남구청\(B010)수치지도_37705092_2022_00000597055733\N3L_A0033330.shp"
"C:\Users\BaekInchan\Desktop\설계스튜디오9_졸업설계\맵모델링\강남구청\(B010)수치지도_37705092_2022_00000597055733\N3L_B0020000.shp"
"C:\Users\BaekInchan\Desktop\설계스튜디오9_졸업설계\맵모델링\강남구청\(B010)수치지도_37705092_2022_00000597055733\N3L_C0070000.shp"
"C:\Users\BaekInchan\Desktop\설계스튜디오9_졸업설계\맵모델링\강남구청\(B010)수치지도_37705092_2022_00000597055733\N3L_C0520000.shp"
"C:\Users\BaekInchan\Desktop\설계스튜디오9_졸업설계\맵모델링\강남구청\(B010)수치지도_37705092_2022_00000597055733\N3L_E0020000.shp"
"C:\Users\BaekInchan\Desktop\설계스튜디오9_졸업설계\맵모델링\강남구청\(B010)수치지도_37705092_2022_00000597055733\N3L_F0010000.shp"
"C:\Users\BaekInchan\Desktop\설계스튜디오9_졸업설계\맵모델링\강남구청\(B010)수치지도_37705092_2022_00000597055733\N3L_F0040000.shp"
"C:\Users\BaekInchan\Desktop\설계스튜디오9_졸업설계\맵모델링\강남구청\(B010)수치지도_37705092_2022_00000597055733\N3L_G0030000.shp"
"C:\Users\BaekInchan\Desktop\설계스튜디오9_졸업설계\맵모델링\강남구청\(B010)수치지도_37705092_2022_00000597055733\N3L_H0010000.shp"
"C:\Users\BaekInchan\Desktop\설계스튜디오9_졸업설계\맵모델링\강남구청\(B010)수치지도_37705092_2022_00000597055733\N3P_A0131122.shp"
"C:\Users\BaekInchan\Desktop\설계스튜디오9_졸업설계\맵모델링\강남구청\(B010)수치지도_37705092_2022_00000597055733\N3P_C0285311.shp"
"C:\Users\BaekInchan\Desktop\설계스튜디오9_졸업설계\맵모델링\강남구청\(B010)수치지도_37705092_2022_00000597055733\N3P_C0310000.shp"
"C:\Users\BaekInchan\Desktop\설계스튜디오9_졸업설계\맵모델링\강남구청\(B010)수치지도_37705092_2022_00000597055733\N3P_C0380000.shp"
"C:\Users\BaekInchan\Desktop\설계스튜디오9_졸업설계\맵모델링\강남구청\(B010)수치지도_37705092_2022_00000597055733\N3P_F0020000.shp"
""")
panel_11 = Panel(""""C:\Users\BaekInchan\Desktop\설계스튜디오9_졸업설계\맵모델링\신사\N3P_H0059153.shp"
"C:\Users\BaekInchan\Desktop\설계스튜디오9_졸업설계\맵모델링\신사\N3A_A0010000.shp"
"C:\Users\BaekInchan\Desktop\설계스튜디오9_졸업설계\맵모델링\신사\N3A_A0033320.shp"
"C:\Users\BaekInchan\Desktop\설계스튜디오9_졸업설계\맵모델링\신사\N3A_A0053326.shp"
"C:\Users\BaekInchan\Desktop\설계스튜디오9_졸업설계\맵모델링\신사\N3A_A0063321.shp"
"C:\Users\BaekInchan\Desktop\설계스튜디오9_졸업설계\맵모델링\신사\N3A_A0070000.shp"
"C:\Users\BaekInchan\Desktop\설계스튜디오9_졸업설계\맵모델링\신사\N3A_A0080000.shp"
"C:\Users\BaekInchan\Desktop\설계스튜디오9_졸업설계\맵모델링\신사\N3A_A0090000.shp"
"C:\Users\BaekInchan\Desktop\설계스튜디오9_졸업설계\맵모델링\신사\N3A_A0100000.shp"
"C:\Users\BaekInchan\Desktop\설계스튜디오9_졸업설계\맵모델링\신사\N3A_A0110020.shp"
"C:\Users\BaekInchan\Desktop\설계스튜디오9_졸업설계\맵모델링\신사\N3A_A0160024.shp"
"C:\Users\BaekInchan\Desktop\설계스튜디오9_졸업설계\맵모델링\신사\N3A_A0191221.shp"
"C:\Users\BaekInchan\Desktop\설계스튜디오9_졸업설계\맵모델링\신사\N3A_A0201222.shp"
"C:\Users\BaekInchan\Desktop\설계스튜디오9_졸업설계\맵모델링\신사\N3A_B0010000.shp"
"C:\Users\BaekInchan\Desktop\설계스튜디오9_졸업설계\맵모델링\신사\N3A_C0186115.shp"
"C:\Users\BaekInchan\Desktop\설계스튜디오9_졸업설계\맵모델링\신사\N3A_C0390000.shp"
"C:\Users\BaekInchan\Desktop\설계스튜디오9_졸업설계\맵모델링\신사\N3A_C0423365.shp"
"C:\Users\BaekInchan\Desktop\설계스튜디오9_졸업설계\맵모델링\신사\N3A_C0430000.shp"
"C:\Users\BaekInchan\Desktop\설계스튜디오9_졸업설계\맵모델링\신사\N3A_D0010000.shp"
"C:\Users\BaekInchan\Desktop\설계스튜디오9_졸업설계\맵모델링\신사\N3A_E0010001.shp"
"C:\Users\BaekInchan\Desktop\설계스튜디오9_졸업설계\맵모델링\신사\N3A_E0032111.shp"
"C:\Users\BaekInchan\Desktop\설계스튜디오9_졸업설계\맵모델링\신사\N3A_E0052114.shp"
"C:\Users\BaekInchan\Desktop\설계스튜디오9_졸업설계\맵모델링\신사\N3A_G0010000.shp"
"C:\Users\BaekInchan\Desktop\설계스튜디오9_졸업설계\맵모델링\신사\N3A_G0020000.shp"
"C:\Users\BaekInchan\Desktop\설계스튜디오9_졸업설계\맵모델링\신사\N3L_A0010000.shp"
"C:\Users\BaekInchan\Desktop\설계스튜디오9_졸업설계\맵모델링\신사\N3L_A0020000.shp"
"C:\Users\BaekInchan\Desktop\설계스튜디오9_졸업설계\맵모델링\신사\N3L_A0033320.shp"
"C:\Users\BaekInchan\Desktop\설계스튜디오9_졸업설계\맵모델링\신사\N3L_A0123373.shp"
"C:\Users\BaekInchan\Desktop\설계스튜디오9_졸업설계\맵모델링\신사\N3L_A0150000.shp"
"C:\Users\BaekInchan\Desktop\설계스튜디오9_졸업설계\맵모델링\신사\N3L_A0171119.shp"
"C:\Users\BaekInchan\Desktop\설계스튜디오9_졸업설계\맵모델링\신사\N3L_B0020000.shp"
"C:\Users\BaekInchan\Desktop\설계스튜디오9_졸업설계\맵모델링\신사\N3L_C0050000.shp"
"C:\Users\BaekInchan\Desktop\설계스튜디오9_졸업설계\맵모델링\신사\N3L_C0060000.shp"
"C:\Users\BaekInchan\Desktop\설계스튜디오9_졸업설계\맵모델링\신사\N3L_C0520000.shp"
"C:\Users\BaekInchan\Desktop\설계스튜디오9_졸업설계\맵모델링\신사\N3L_E0020000.shp"
"C:\Users\BaekInchan\Desktop\설계스튜디오9_졸업설계\맵모델링\신사\N3L_F0010000.shp"
"C:\Users\BaekInchan\Desktop\설계스튜디오9_졸업설계\맵모델링\신사\N3L_F0030000.shp"
"C:\Users\BaekInchan\Desktop\설계스튜디오9_졸업설계\맵모델링\신사\N3L_F0040000.shp"
"C:\Users\BaekInchan\Desktop\설계스튜디오9_졸업설계\맵모델링\신사\N3L_G0030000.shp"
"C:\Users\BaekInchan\Desktop\설계스튜디오9_졸업설계\맵모델링\신사\N3L_H0010000.shp"
"C:\Users\BaekInchan\Desktop\설계스튜디오9_졸업설계\맵모델링\신사\N3P_A0131122.shp"
"C:\Users\BaekInchan\Desktop\설계스튜디오9_졸업설계\맵모델링\신사\N3P_C0380000.shp"
"C:\Users\BaekInchan\Desktop\설계스튜디오9_졸업설계\맵모델링\신사\N3P_E0042326.shp"
"C:\Users\BaekInchan\Desktop\설계스튜디오9_졸업설계\맵모델링\신사\N3P_F0020000.shp"
"C:\Users\BaekInchan\Desktop\설계스튜디오9_졸업설계\맵모델링\신사\N3P_H0020000.shp"
"C:\Users\BaekInchan\Desktop\설계스튜디오9_졸업설계\맵모델링\신사\N3P_H0040000.shp"
""")
panel_12 = Panel(""""C:\Users\BaekInchan\Desktop\설계스튜디오9_졸업설계\맵모델링\논현역\(B010)수치지도_37705091_2022_00000452529185\N3P_H0040000.shp"
"C:\Users\BaekInchan\Desktop\설계스튜디오9_졸업설계\맵모델링\논현역\(B010)수치지도_37705091_2022_00000452529185\N3A_A0010000.shp"
"C:\Users\BaekInchan\Desktop\설계스튜디오9_졸업설계\맵모델링\논현역\(B010)수치지도_37705091_2022_00000452529185\N3A_A0033320.shp"
"C:\Users\BaekInchan\Desktop\설계스튜디오9_졸업설계\맵모델링\논현역\(B010)수치지도_37705091_2022_00000452529185\N3A_A0053326.shp"
"C:\Users\BaekInchan\Desktop\설계스튜디오9_졸업설계\맵모델링\논현역\(B010)수치지도_37705091_2022_00000452529185\N3A_A0063321.shp"
"C:\Users\BaekInchan\Desktop\설계스튜디오9_졸업설계\맵모델링\논현역\(B010)수치지도_37705091_2022_00000452529185\N3A_A0070000.shp"
"C:\Users\BaekInchan\Desktop\설계스튜디오9_졸업설계\맵모델링\논현역\(B010)수치지도_37705091_2022_00000452529185\N3A_A0080000.shp"
"C:\Users\BaekInchan\Desktop\설계스튜디오9_졸업설계\맵모델링\논현역\(B010)수치지도_37705091_2022_00000452529185\N3A_A0090000.shp"
"C:\Users\BaekInchan\Desktop\설계스튜디오9_졸업설계\맵모델링\논현역\(B010)수치지도_37705091_2022_00000452529185\N3A_A0100000.shp"
"C:\Users\BaekInchan\Desktop\설계스튜디오9_졸업설계\맵모델링\논현역\(B010)수치지도_37705091_2022_00000452529185\N3A_A0160024.shp"
"C:\Users\BaekInchan\Desktop\설계스튜디오9_졸업설계\맵모델링\논현역\(B010)수치지도_37705091_2022_00000452529185\N3A_B0010000.shp"
"C:\Users\BaekInchan\Desktop\설계스튜디오9_졸업설계\맵모델링\논현역\(B010)수치지도_37705091_2022_00000452529185\N3A_C0186115.shp"
"C:\Users\BaekInchan\Desktop\설계스튜디오9_졸업설계\맵모델링\논현역\(B010)수치지도_37705091_2022_00000452529185\N3A_C0390000.shp"
"C:\Users\BaekInchan\Desktop\설계스튜디오9_졸업설계\맵모델링\논현역\(B010)수치지도_37705091_2022_00000452529185\N3A_C0423365.shp"
"C:\Users\BaekInchan\Desktop\설계스튜디오9_졸업설계\맵모델링\논현역\(B010)수치지도_37705091_2022_00000452529185\N3A_C0430000.shp"
"C:\Users\BaekInchan\Desktop\설계스튜디오9_졸업설계\맵모델링\논현역\(B010)수치지도_37705091_2022_00000452529185\N3A_D0010000.shp"
"C:\Users\BaekInchan\Desktop\설계스튜디오9_졸업설계\맵모델링\논현역\(B010)수치지도_37705091_2022_00000452529185\N3A_E0010001.shp"
"C:\Users\BaekInchan\Desktop\설계스튜디오9_졸업설계\맵모델링\논현역\(B010)수치지도_37705091_2022_00000452529185\N3A_E0032111.shp"
"C:\Users\BaekInchan\Desktop\설계스튜디오9_졸업설계\맵모델링\논현역\(B010)수치지도_37705091_2022_00000452529185\N3A_E0052114.shp"
"C:\Users\BaekInchan\Desktop\설계스튜디오9_졸업설계\맵모델링\논현역\(B010)수치지도_37705091_2022_00000452529185\N3A_G0010000.shp"
"C:\Users\BaekInchan\Desktop\설계스튜디오9_졸업설계\맵모델링\논현역\(B010)수치지도_37705091_2022_00000452529185\N3A_G0020000.shp"
"C:\Users\BaekInchan\Desktop\설계스튜디오9_졸업설계\맵모델링\논현역\(B010)수치지도_37705091_2022_00000452529185\N3L_A0010000.shp"
"C:\Users\BaekInchan\Desktop\설계스튜디오9_졸업설계\맵모델링\논현역\(B010)수치지도_37705091_2022_00000452529185\N3L_A0020000.shp"
"C:\Users\BaekInchan\Desktop\설계스튜디오9_졸업설계\맵모델링\논현역\(B010)수치지도_37705091_2022_00000452529185\N3L_A0033330.shp"
"C:\Users\BaekInchan\Desktop\설계스튜디오9_졸업설계\맵모델링\논현역\(B010)수치지도_37705091_2022_00000452529185\N3L_A0150000.shp"
"C:\Users\BaekInchan\Desktop\설계스튜디오9_졸업설계\맵모델링\논현역\(B010)수치지도_37705091_2022_00000452529185\N3L_A0171119.shp"
"C:\Users\BaekInchan\Desktop\설계스튜디오9_졸업설계\맵모델링\논현역\(B010)수치지도_37705091_2022_00000452529185\N3L_B0020000.shp"
"C:\Users\BaekInchan\Desktop\설계스튜디오9_졸업설계\맵모델링\논현역\(B010)수치지도_37705091_2022_00000452529185\N3L_C0050000.shp"
"C:\Users\BaekInchan\Desktop\설계스튜디오9_졸업설계\맵모델링\논현역\(B010)수치지도_37705091_2022_00000452529185\N3L_C0060000.shp"
"C:\Users\BaekInchan\Desktop\설계스튜디오9_졸업설계\맵모델링\논현역\(B010)수치지도_37705091_2022_00000452529185\N3L_C0070000.shp"
"C:\Users\BaekInchan\Desktop\설계스튜디오9_졸업설계\맵모델링\논현역\(B010)수치지도_37705091_2022_00000452529185\N3L_C0520000.shp"
"C:\Users\BaekInchan\Desktop\설계스튜디오9_졸업설계\맵모델링\논현역\(B010)수치지도_37705091_2022_00000452529185\N3L_E0020000.shp"
"C:\Users\BaekInchan\Desktop\설계스튜디오9_졸업설계\맵모델링\논현역\(B010)수치지도_37705091_2022_00000452529185\N3L_F0010000.shp"
"C:\Users\BaekInchan\Desktop\설계스튜디오9_졸업설계\맵모델링\논현역\(B010)수치지도_37705091_2022_00000452529185\N3L_F0030000.shp"
"C:\Users\BaekInchan\Desktop\설계스튜디오9_졸업설계\맵모델링\논현역\(B010)수치지도_37705091_2022_00000452529185\N3L_F0040000.shp"
"C:\Users\BaekInchan\Desktop\설계스튜디오9_졸업설계\맵모델링\논현역\(B010)수치지도_37705091_2022_00000452529185\N3L_G0030000.shp"
"C:\Users\BaekInchan\Desktop\설계스튜디오9_졸업설계\맵모델링\논현역\(B010)수치지도_37705091_2022_00000452529185\N3L_H0010000.shp"
"C:\Users\BaekInchan\Desktop\설계스튜디오9_졸업설계\맵모델링\논현역\(B010)수치지도_37705091_2022_00000452529185\N3P_A0131122.shp"
"C:\Users\BaekInchan\Desktop\설계스튜디오9_졸업설계\맵모델링\논현역\(B010)수치지도_37705091_2022_00000452529185\N3P_C0380000.shp"
"C:\Users\BaekInchan\Desktop\설계스튜디오9_졸업설계\맵모델링\논현역\(B010)수치지도_37705091_2022_00000452529185\N3P_D0030000.shp"
"C:\Users\BaekInchan\Desktop\설계스튜디오9_졸업설계\맵모델링\논현역\(B010)수치지도_37705091_2022_00000452529185\N3P_E0042326.shp"
"C:\Users\BaekInchan\Desktop\설계스튜디오9_졸업설계\맵모델링\논현역\(B010)수치지도_37705091_2022_00000452529185\N3P_F0020000.shp"
"C:\Users\BaekInchan\Desktop\설계스튜디오9_졸업설계\맵모델링\논현역\(B010)수치지도_37705091_2022_00000452529185\N3P_H0020000.shp"
""")
panel_13 = Panel(""""C:\Users\BaekInchan\Desktop\설계스튜디오9_졸업설계\맵모델링\신사\N3P_H0059153.shp"
"C:\Users\BaekInchan\Desktop\설계스튜디오9_졸업설계\맵모델링\신사\N3A_A0010000.shp"
"C:\Users\BaekInchan\Desktop\설계스튜디오9_졸업설계\맵모델링\신사\N3A_A0033320.shp"
"C:\Users\BaekInchan\Desktop\설계스튜디오9_졸업설계\맵모델링\신사\N3A_A0053326.shp"
"C:\Users\BaekInchan\Desktop\설계스튜디오9_졸업설계\맵모델링\신사\N3A_A0063321.shp"
"C:\Users\BaekInchan\Desktop\설계스튜디오9_졸업설계\맵모델링\신사\N3A_A0070000.shp"
"C:\Users\BaekInchan\Desktop\설계스튜디오9_졸업설계\맵모델링\신사\N3A_A0080000.shp"
"C:\Users\BaekInchan\Desktop\설계스튜디오9_졸업설계\맵모델링\신사\N3A_A0090000.shp"
"C:\Users\BaekInchan\Desktop\설계스튜디오9_졸업설계\맵모델링\신사\N3A_A0100000.shp"
"C:\Users\BaekInchan\Desktop\설계스튜디오9_졸업설계\맵모델링\신사\N3A_A0110020.shp"
"C:\Users\BaekInchan\Desktop\설계스튜디오9_졸업설계\맵모델링\신사\N3A_A0160024.shp"
"C:\Users\BaekInchan\Desktop\설계스튜디오9_졸업설계\맵모델링\신사\N3A_A0191221.shp"
"C:\Users\BaekInchan\Desktop\설계스튜디오9_졸업설계\맵모델링\신사\N3A_A0201222.shp"
"C:\Users\BaekInchan\Desktop\설계스튜디오9_졸업설계\맵모델링\신사\N3A_B0010000.shp"
"C:\Users\BaekInchan\Desktop\설계스튜디오9_졸업설계\맵모델링\신사\N3A_C0186115.shp"
"C:\Users\BaekInchan\Desktop\설계스튜디오9_졸업설계\맵모델링\신사\N3A_C0390000.shp"
"C:\Users\BaekInchan\Desktop\설계스튜디오9_졸업설계\맵모델링\신사\N3A_C0423365.shp"
"C:\Users\BaekInchan\Desktop\설계스튜디오9_졸업설계\맵모델링\신사\N3A_C0430000.shp"
"C:\Users\BaekInchan\Desktop\설계스튜디오9_졸업설계\맵모델링\신사\N3A_D0010000.shp"
"C:\Users\BaekInchan\Desktop\설계스튜디오9_졸업설계\맵모델링\신사\N3A_E0010001.shp"
"C:\Users\BaekInchan\Desktop\설계스튜디오9_졸업설계\맵모델링\신사\N3A_E0032111.shp"
"C:\Users\BaekInchan\Desktop\설계스튜디오9_졸업설계\맵모델링\신사\N3A_E0052114.shp"
"C:\Users\BaekInchan\Desktop\설계스튜디오9_졸업설계\맵모델링\신사\N3A_G0010000.shp"
"C:\Users\BaekInchan\Desktop\설계스튜디오9_졸업설계\맵모델링\신사\N3A_G0020000.shp"
"C:\Users\BaekInchan\Desktop\설계스튜디오9_졸업설계\맵모델링\신사\N3L_A0010000.shp"
"C:\Users\BaekInchan\Desktop\설계스튜디오9_졸업설계\맵모델링\신사\N3L_A0020000.shp"
"C:\Users\BaekInchan\Desktop\설계스튜디오9_졸업설계\맵모델링\신사\N3L_A0033320.shp"
"C:\Users\BaekInchan\Desktop\설계스튜디오9_졸업설계\맵모델링\신사\N3L_A0123373.shp"
"C:\Users\BaekInchan\Desktop\설계스튜디오9_졸업설계\맵모델링\신사\N3L_A0150000.shp"
"C:\Users\BaekInchan\Desktop\설계스튜디오9_졸업설계\맵모델링\신사\N3L_A0171119.shp"
"C:\Users\BaekInchan\Desktop\설계스튜디오9_졸업설계\맵모델링\신사\N3L_B0020000.shp"
"C:\Users\BaekInchan\Desktop\설계스튜디오9_졸업설계\맵모델링\신사\N3L_C0050000.shp"
"C:\Users\BaekInchan\Desktop\설계스튜디오9_졸업설계\맵모델링\신사\N3L_C0060000.shp"
"C:\Users\BaekInchan\Desktop\설계스튜디오9_졸업설계\맵모델링\신사\N3L_C0520000.shp"
"C:\Users\BaekInchan\Desktop\설계스튜디오9_졸업설계\맵모델링\신사\N3L_E0020000.shp"
"C:\Users\BaekInchan\Desktop\설계스튜디오9_졸업설계\맵모델링\신사\N3L_F0010000.shp"
"C:\Users\BaekInchan\Desktop\설계스튜디오9_졸업설계\맵모델링\신사\N3L_F0030000.shp"
"C:\Users\BaekInchan\Desktop\설계스튜디오9_졸업설계\맵모델링\신사\N3L_F0040000.shp"
"C:\Users\BaekInchan\Desktop\설계스튜디오9_졸업설계\맵모델링\신사\N3L_G0030000.shp"
"C:\Users\BaekInchan\Desktop\설계스튜디오9_졸업설계\맵모델링\신사\N3L_H0010000.shp"
"C:\Users\BaekInchan\Desktop\설계스튜디오9_졸업설계\맵모델링\신사\N3P_A0131122.shp"
"C:\Users\BaekInchan\Desktop\설계스튜디오9_졸업설계\맵모델링\신사\N3P_C0380000.shp"
"C:\Users\BaekInchan\Desktop\설계스튜디오9_졸업설계\맵모델링\신사\N3P_E0042326.shp"
"C:\Users\BaekInchan\Desktop\설계스튜디오9_졸업설계\맵모델링\신사\N3P_F0020000.shp"
"C:\Users\BaekInchan\Desktop\설계스튜디오9_졸업설계\맵모델링\신사\N3P_H0020000.shp"
"C:\Users\BaekInchan\Desktop\설계스튜디오9_졸업설계\맵모델링\신사\N3P_H0040000.shp"
""")  # disabled
panel_14 = Panel(""""C:\Users\BaekInchan\Desktop\설계스튜디오9_졸업설계\맵모델링\강남구청\(B010)수치지도_37705092_2022_00000597055733\N3P_H0040000.shp"
"C:\Users\BaekInchan\Desktop\설계스튜디오9_졸업설계\맵모델링\강남구청\(B010)수치지도_37705092_2022_00000597055733\N3A_A0010000.shp"
"C:\Users\BaekInchan\Desktop\설계스튜디오9_졸업설계\맵모델링\강남구청\(B010)수치지도_37705092_2022_00000597055733\N3A_A0033320.shp"
"C:\Users\BaekInchan\Desktop\설계스튜디오9_졸업설계\맵모델링\강남구청\(B010)수치지도_37705092_2022_00000597055733\N3A_A0053326.shp"
"C:\Users\BaekInchan\Desktop\설계스튜디오9_졸업설계\맵모델링\강남구청\(B010)수치지도_37705092_2022_00000597055733\N3A_A0080000.shp"
"C:\Users\BaekInchan\Desktop\설계스튜디오9_졸업설계\맵모델링\강남구청\(B010)수치지도_37705092_2022_00000597055733\N3A_B0010000.shp"
"C:\Users\BaekInchan\Desktop\설계스튜디오9_졸업설계\맵모델링\강남구청\(B010)수치지도_37705092_2022_00000597055733\N3A_C0186115.shp"
"C:\Users\BaekInchan\Desktop\설계스튜디오9_졸업설계\맵모델링\강남구청\(B010)수치지도_37705092_2022_00000597055733\N3A_C0305316.shp"
"C:\Users\BaekInchan\Desktop\설계스튜디오9_졸업설계\맵모델링\강남구청\(B010)수치지도_37705092_2022_00000597055733\N3A_C0390000.shp"
"C:\Users\BaekInchan\Desktop\설계스튜디오9_졸업설계\맵모델링\강남구청\(B010)수치지도_37705092_2022_00000597055733\N3A_C0423365.shp"
"C:\Users\BaekInchan\Desktop\설계스튜디오9_졸업설계\맵모델링\강남구청\(B010)수치지도_37705092_2022_00000597055733\N3A_C0430000.shp"
"C:\Users\BaekInchan\Desktop\설계스튜디오9_졸업설계\맵모델링\강남구청\(B010)수치지도_37705092_2022_00000597055733\N3A_G0010000.shp"
"C:\Users\BaekInchan\Desktop\설계스튜디오9_졸업설계\맵모델링\강남구청\(B010)수치지도_37705092_2022_00000597055733\N3L_A0010000.shp"
"C:\Users\BaekInchan\Desktop\설계스튜디오9_졸업설계\맵모델링\강남구청\(B010)수치지도_37705092_2022_00000597055733\N3L_A0020000.shp"
"C:\Users\BaekInchan\Desktop\설계스튜디오9_졸업설계\맵모델링\강남구청\(B010)수치지도_37705092_2022_00000597055733\N3L_A0033330.shp"
"C:\Users\BaekInchan\Desktop\설계스튜디오9_졸업설계\맵모델링\강남구청\(B010)수치지도_37705092_2022_00000597055733\N3L_B0020000.shp"
"C:\Users\BaekInchan\Desktop\설계스튜디오9_졸업설계\맵모델링\강남구청\(B010)수치지도_37705092_2022_00000597055733\N3L_C0070000.shp"
"C:\Users\BaekInchan\Desktop\설계스튜디오9_졸업설계\맵모델링\강남구청\(B010)수치지도_37705092_2022_00000597055733\N3L_C0520000.shp"
"C:\Users\BaekInchan\Desktop\설계스튜디오9_졸업설계\맵모델링\강남구청\(B010)수치지도_37705092_2022_00000597055733\N3L_E0020000.shp"
"C:\Users\BaekInchan\Desktop\설계스튜디오9_졸업설계\맵모델링\강남구청\(B010)수치지도_37705092_2022_00000597055733\N3L_F0010000.shp"
"C:\Users\BaekInchan\Desktop\설계스튜디오9_졸업설계\맵모델링\강남구청\(B010)수치지도_37705092_2022_00000597055733\N3L_F0040000.shp"
"C:\Users\BaekInchan\Desktop\설계스튜디오9_졸업설계\맵모델링\강남구청\(B010)수치지도_37705092_2022_00000597055733\N3L_G0030000.shp"
"C:\Users\BaekInchan\Desktop\설계스튜디오9_졸업설계\맵모델링\강남구청\(B010)수치지도_37705092_2022_00000597055733\N3L_H0010000.shp"
"C:\Users\BaekInchan\Desktop\설계스튜디오9_졸업설계\맵모델링\강남구청\(B010)수치지도_37705092_2022_00000597055733\N3P_A0131122.shp"
"C:\Users\BaekInchan\Desktop\설계스튜디오9_졸업설계\맵모델링\강남구청\(B010)수치지도_37705092_2022_00000597055733\N3P_C0285311.shp"
"C:\Users\BaekInchan\Desktop\설계스튜디오9_졸업설계\맵모델링\강남구청\(B010)수치지도_37705092_2022_00000597055733\N3P_C0310000.shp"
"C:\Users\BaekInchan\Desktop\설계스튜디오9_졸업설계\맵모델링\강남구청\(B010)수치지도_37705092_2022_00000597055733\N3P_C0380000.shp"
"C:\Users\BaekInchan\Desktop\설계스튜디오9_졸업설계\맵모델링\강남구청\(B010)수치지도_37705092_2022_00000597055733\N3P_F0020000.shp"
""")  # disabled
panel_15 = Panel(""""C:\Users\BaekInchan\Desktop\설계스튜디오9_졸업설계\맵모델링\논현역\(B010)수치지도_37705091_2022_00000452529185\N3P_H0040000.shp"
"C:\Users\BaekInchan\Desktop\설계스튜디오9_졸업설계\맵모델링\논현역\(B010)수치지도_37705091_2022_00000452529185\N3A_A0010000.shp"
"C:\Users\BaekInchan\Desktop\설계스튜디오9_졸업설계\맵모델링\논현역\(B010)수치지도_37705091_2022_00000452529185\N3A_A0033320.shp"
"C:\Users\BaekInchan\Desktop\설계스튜디오9_졸업설계\맵모델링\논현역\(B010)수치지도_37705091_2022_00000452529185\N3A_A0053326.shp"
"C:\Users\BaekInchan\Desktop\설계스튜디오9_졸업설계\맵모델링\논현역\(B010)수치지도_37705091_2022_00000452529185\N3A_A0063321.shp"
"C:\Users\BaekInchan\Desktop\설계스튜디오9_졸업설계\맵모델링\논현역\(B010)수치지도_37705091_2022_00000452529185\N3A_A0070000.shp"
"C:\Users\BaekInchan\Desktop\설계스튜디오9_졸업설계\맵모델링\논현역\(B010)수치지도_37705091_2022_00000452529185\N3A_A0080000.shp"
"C:\Users\BaekInchan\Desktop\설계스튜디오9_졸업설계\맵모델링\논현역\(B010)수치지도_37705091_2022_00000452529185\N3A_A0090000.shp"
"C:\Users\BaekInchan\Desktop\설계스튜디오9_졸업설계\맵모델링\논현역\(B010)수치지도_37705091_2022_00000452529185\N3A_A0100000.shp"
"C:\Users\BaekInchan\Desktop\설계스튜디오9_졸업설계\맵모델링\논현역\(B010)수치지도_37705091_2022_00000452529185\N3A_A0160024.shp"
"C:\Users\BaekInchan\Desktop\설계스튜디오9_졸업설계\맵모델링\논현역\(B010)수치지도_37705091_2022_00000452529185\N3A_B0010000.shp"
"C:\Users\BaekInchan\Desktop\설계스튜디오9_졸업설계\맵모델링\논현역\(B010)수치지도_37705091_2022_00000452529185\N3A_C0186115.shp"
"C:\Users\BaekInchan\Desktop\설계스튜디오9_졸업설계\맵모델링\논현역\(B010)수치지도_37705091_2022_00000452529185\N3A_C0390000.shp"
"C:\Users\BaekInchan\Desktop\설계스튜디오9_졸업설계\맵모델링\논현역\(B010)수치지도_37705091_2022_00000452529185\N3A_C0423365.shp"
"C:\Users\BaekInchan\Desktop\설계스튜디오9_졸업설계\맵모델링\논현역\(B010)수치지도_37705091_2022_00000452529185\N3A_C0430000.shp"
"C:\Users\BaekInchan\Desktop\설계스튜디오9_졸업설계\맵모델링\논현역\(B010)수치지도_37705091_2022_00000452529185\N3A_D0010000.shp"
"C:\Users\BaekInchan\Desktop\설계스튜디오9_졸업설계\맵모델링\논현역\(B010)수치지도_37705091_2022_00000452529185\N3A_E0010001.shp"
"C:\Users\BaekInchan\Desktop\설계스튜디오9_졸업설계\맵모델링\논현역\(B010)수치지도_37705091_2022_00000452529185\N3A_E0032111.shp"
"C:\Users\BaekInchan\Desktop\설계스튜디오9_졸업설계\맵모델링\논현역\(B010)수치지도_37705091_2022_00000452529185\N3A_E0052114.shp"
"C:\Users\BaekInchan\Desktop\설계스튜디오9_졸업설계\맵모델링\논현역\(B010)수치지도_37705091_2022_00000452529185\N3A_G0010000.shp"
"C:\Users\BaekInchan\Desktop\설계스튜디오9_졸업설계\맵모델링\논현역\(B010)수치지도_37705091_2022_00000452529185\N3A_G0020000.shp"
"C:\Users\BaekInchan\Desktop\설계스튜디오9_졸업설계\맵모델링\논현역\(B010)수치지도_37705091_2022_00000452529185\N3L_A0010000.shp"
"C:\Users\BaekInchan\Desktop\설계스튜디오9_졸업설계\맵모델링\논현역\(B010)수치지도_37705091_2022_00000452529185\N3L_A0020000.shp"
"C:\Users\BaekInchan\Desktop\설계스튜디오9_졸업설계\맵모델링\논현역\(B010)수치지도_37705091_2022_00000452529185\N3L_A0033330.shp"
"C:\Users\BaekInchan\Desktop\설계스튜디오9_졸업설계\맵모델링\논현역\(B010)수치지도_37705091_2022_00000452529185\N3L_A0150000.shp"
"C:\Users\BaekInchan\Desktop\설계스튜디오9_졸업설계\맵모델링\논현역\(B010)수치지도_37705091_2022_00000452529185\N3L_A0171119.shp"
"C:\Users\BaekInchan\Desktop\설계스튜디오9_졸업설계\맵모델링\논현역\(B010)수치지도_37705091_2022_00000452529185\N3L_B0020000.shp"
"C:\Users\BaekInchan\Desktop\설계스튜디오9_졸업설계\맵모델링\논현역\(B010)수치지도_37705091_2022_00000452529185\N3L_C0050000.shp"
"C:\Users\BaekInchan\Desktop\설계스튜디오9_졸업설계\맵모델링\논현역\(B010)수치지도_37705091_2022_00000452529185\N3L_C0060000.shp"
"C:\Users\BaekInchan\Desktop\설계스튜디오9_졸업설계\맵모델링\논현역\(B010)수치지도_37705091_2022_00000452529185\N3L_C0070000.shp"
"C:\Users\BaekInchan\Desktop\설계스튜디오9_졸업설계\맵모델링\논현역\(B010)수치지도_37705091_2022_00000452529185\N3L_C0520000.shp"
"C:\Users\BaekInchan\Desktop\설계스튜디오9_졸업설계\맵모델링\논현역\(B010)수치지도_37705091_2022_00000452529185\N3L_E0020000.shp"
"C:\Users\BaekInchan\Desktop\설계스튜디오9_졸업설계\맵모델링\논현역\(B010)수치지도_37705091_2022_00000452529185\N3L_F0010000.shp"
"C:\Users\BaekInchan\Desktop\설계스튜디오9_졸업설계\맵모델링\논현역\(B010)수치지도_37705091_2022_00000452529185\N3L_F0030000.shp"
"C:\Users\BaekInchan\Desktop\설계스튜디오9_졸업설계\맵모델링\논현역\(B010)수치지도_37705091_2022_00000452529185\N3L_F0040000.shp"
"C:\Users\BaekInchan\Desktop\설계스튜디오9_졸업설계\맵모델링\논현역\(B010)수치지도_37705091_2022_00000452529185\N3L_G0030000.shp"
"C:\Users\BaekInchan\Desktop\설계스튜디오9_졸업설계\맵모델링\논현역\(B010)수치지도_37705091_2022_00000452529185\N3L_H0010000.shp"
"C:\Users\BaekInchan\Desktop\설계스튜디오9_졸업설계\맵모델링\논현역\(B010)수치지도_37705091_2022_00000452529185\N3P_A0131122.shp"
"C:\Users\BaekInchan\Desktop\설계스튜디오9_졸업설계\맵모델링\논현역\(B010)수치지도_37705091_2022_00000452529185\N3P_C0380000.shp"
"C:\Users\BaekInchan\Desktop\설계스튜디오9_졸업설계\맵모델링\논현역\(B010)수치지도_37705091_2022_00000452529185\N3P_D0030000.shp"
"C:\Users\BaekInchan\Desktop\설계스튜디오9_졸업설계\맵모델링\논현역\(B010)수치지도_37705091_2022_00000452529185\N3P_E0042326.shp"
"C:\Users\BaekInchan\Desktop\설계스튜디오9_졸업설계\맵모델링\논현역\(B010)수치지도_37705091_2022_00000452529185\N3P_F0020000.shp"
"C:\Users\BaekInchan\Desktop\설계스튜디오9_졸업설계\맵모델링\논현역\(B010)수치지도_37705091_2022_00000452529185\N3P_H0020000.shp"
""")  # disabled
# 지형
panel_16 = Panel(""""C:\Users\BaekInchan\Desktop\설계스튜디오9_졸업설계\맵모델링\압구정\N3A_A0010000.shp"
"C:\Users\BaekInchan\Desktop\설계스튜디오9_졸업설계\맵모델링\압구정\N3A_A0033320.shp"
"C:\Users\BaekInchan\Desktop\설계스튜디오9_졸업설계\맵모델링\압구정\N3A_A0053326.shp"
"C:\Users\BaekInchan\Desktop\설계스튜디오9_졸업설계\맵모델링\압구정\N3A_A0063321.shp"
"C:\Users\BaekInchan\Desktop\설계스튜디오9_졸업설계\맵모델링\압구정\N3A_A0070000.shp"
"C:\Users\BaekInchan\Desktop\설계스튜디오9_졸업설계\맵모델링\압구정\N3A_A0080000.shp"
"C:\Users\BaekInchan\Desktop\설계스튜디오9_졸업설계\맵모델링\압구정\N3A_A0090000.shp"
"C:\Users\BaekInchan\Desktop\설계스튜디오9_졸업설계\맵모델링\압구정\N3A_A0100000.shp"
"C:\Users\BaekInchan\Desktop\설계스튜디오9_졸업설계\맵모델링\압구정\N3A_A0110020.shp"
"C:\Users\BaekInchan\Desktop\설계스튜디오9_졸업설계\맵모델링\압구정\N3A_A0160024.shp"
"C:\Users\BaekInchan\Desktop\설계스튜디오9_졸업설계\맵모델링\압구정\N3A_A0191221.shp"
"C:\Users\BaekInchan\Desktop\설계스튜디오9_졸업설계\맵모델링\압구정\N3A_A0201222.shp"
"C:\Users\BaekInchan\Desktop\설계스튜디오9_졸업설계\맵모델링\압구정\N3A_B0010000.shp"
"C:\Users\BaekInchan\Desktop\설계스튜디오9_졸업설계\맵모델링\압구정\N3A_C0186115.shp"
"C:\Users\BaekInchan\Desktop\설계스튜디오9_졸업설계\맵모델링\압구정\N3A_C0390000.shp"
"C:\Users\BaekInchan\Desktop\설계스튜디오9_졸업설계\맵모델링\압구정\N3A_C0423365.shp"
"C:\Users\BaekInchan\Desktop\설계스튜디오9_졸업설계\맵모델링\압구정\N3A_C0430000.shp"
"C:\Users\BaekInchan\Desktop\설계스튜디오9_졸업설계\맵모델링\압구정\N3A_D0010000.shp"
"C:\Users\BaekInchan\Desktop\설계스튜디오9_졸업설계\맵모델링\압구정\N3A_E0010001.shp"
"C:\Users\BaekInchan\Desktop\설계스튜디오9_졸업설계\맵모델링\압구정\N3A_E0032111.shp"
"C:\Users\BaekInchan\Desktop\설계스튜디오9_졸업설계\맵모델링\압구정\N3A_E0052114.shp"
"C:\Users\BaekInchan\Desktop\설계스튜디오9_졸업설계\맵모델링\압구정\N3A_G0010000.shp"
"C:\Users\BaekInchan\Desktop\설계스튜디오9_졸업설계\맵모델링\압구정\N3A_G0020000.shp"
"C:\Users\BaekInchan\Desktop\설계스튜디오9_졸업설계\맵모델링\압구정\N3L_A0010000.shp"
"C:\Users\BaekInchan\Desktop\설계스튜디오9_졸업설계\맵모델링\압구정\N3L_A0020000.shp"
"C:\Users\BaekInchan\Desktop\설계스튜디오9_졸업설계\맵모델링\압구정\N3L_A0033330.shp"
"C:\Users\BaekInchan\Desktop\설계스튜디오9_졸업설계\맵모델링\압구정\N3L_A0123373.shp"
"C:\Users\BaekInchan\Desktop\설계스튜디오9_졸업설계\맵모델링\압구정\N3L_A0150000.shp"
"C:\Users\BaekInchan\Desktop\설계스튜디오9_졸업설계\맵모델링\압구정\N3L_A0171119.shp"
"C:\Users\BaekInchan\Desktop\설계스튜디오9_졸업설계\맵모델링\압구정\N3L_B0020000.shp"
"C:\Users\BaekInchan\Desktop\설계스튜디오9_졸업설계\맵모델링\압구정\N3L_C0050000.shp"
"C:\Users\BaekInchan\Desktop\설계스튜디오9_졸업설계\맵모델링\압구정\N3L_C0060000.shp"
"C:\Users\BaekInchan\Desktop\설계스튜디오9_졸업설계\맵모델링\압구정\N3L_C0070000.shp"
"C:\Users\BaekInchan\Desktop\설계스튜디오9_졸업설계\맵모델링\압구정\N3L_C0520000.shp"
"C:\Users\BaekInchan\Desktop\설계스튜디오9_졸업설계\맵모델링\압구정\N3L_E0020000.shp"
"C:\Users\BaekInchan\Desktop\설계스튜디오9_졸업설계\맵모델링\압구정\N3L_F0010000.shp"
"C:\Users\BaekInchan\Desktop\설계스튜디오9_졸업설계\맵모델링\압구정\N3L_F0030000.shp"
"C:\Users\BaekInchan\Desktop\설계스튜디오9_졸업설계\맵모델링\압구정\N3L_F0040000.shp"
"C:\Users\BaekInchan\Desktop\설계스튜디오9_졸업설계\맵모델링\압구정\N3L_G0030000.shp"
"C:\Users\BaekInchan\Desktop\설계스튜디오9_졸업설계\맵모델링\압구정\N3L_H0010000.shp"
"C:\Users\BaekInchan\Desktop\설계스튜디오9_졸업설계\맵모델링\압구정\N3P_A0131122.shp"
"C:\Users\BaekInchan\Desktop\설계스튜디오9_졸업설계\맵모델링\압구정\N3P_C0210000.shp"
"C:\Users\BaekInchan\Desktop\설계스튜디오9_졸업설계\맵모델링\압구정\N3P_C0380000.shp"
"C:\Users\BaekInchan\Desktop\설계스튜디오9_졸업설계\맵모델링\압구정\N3P_D0030000.shp"
"C:\Users\BaekInchan\Desktop\설계스튜디오9_졸업설계\맵모델링\압구정\N3P_E0042326.shp"
"C:\Users\BaekInchan\Desktop\설계스튜디오9_졸업설계\맵모델링\압구정\N3P_F0020000.shp"
"C:\Users\BaekInchan\Desktop\설계스튜디오9_졸업설계\맵모델링\압구정\N3P_H0020000.shp"
"C:\Users\BaekInchan\Desktop\설계스튜디오9_졸업설계\맵모델링\압구정\N3P_H0040000.shp"
"C:\Users\BaekInchan\Desktop\설계스튜디오9_졸업설계\맵모델링\압구정\N3P_H0059153.shp"
""")  # disabled
panel_17 = Panel(""""C:\Users\BaekInchan\Desktop\설계스튜디오9_졸업설계\맵모델링\강남구청\(B010)수치지도_37705092_2022_00000597055733\N3P_H0040000.shp"
"C:\Users\BaekInchan\Desktop\설계스튜디오9_졸업설계\맵모델링\강남구청\(B010)수치지도_37705092_2022_00000597055733\N3A_A0010000.shp"
"C:\Users\BaekInchan\Desktop\설계스튜디오9_졸업설계\맵모델링\강남구청\(B010)수치지도_37705092_2022_00000597055733\N3A_A0033320.shp"
"C:\Users\BaekInchan\Desktop\설계스튜디오9_졸업설계\맵모델링\강남구청\(B010)수치지도_37705092_2022_00000597055733\N3A_A0053326.shp"
"C:\Users\BaekInchan\Desktop\설계스튜디오9_졸업설계\맵모델링\강남구청\(B010)수치지도_37705092_2022_00000597055733\N3A_A0080000.shp"
"C:\Users\BaekInchan\Desktop\설계스튜디오9_졸업설계\맵모델링\강남구청\(B010)수치지도_37705092_2022_00000597055733\N3A_B0010000.shp"
"C:\Users\BaekInchan\Desktop\설계스튜디오9_졸업설계\맵모델링\강남구청\(B010)수치지도_37705092_2022_00000597055733\N3A_C0186115.shp"
"C:\Users\BaekInchan\Desktop\설계스튜디오9_졸업설계\맵모델링\강남구청\(B010)수치지도_37705092_2022_00000597055733\N3A_C0305316.shp"
"C:\Users\BaekInchan\Desktop\설계스튜디오9_졸업설계\맵모델링\강남구청\(B010)수치지도_37705092_2022_00000597055733\N3A_C0390000.shp"
"C:\Users\BaekInchan\Desktop\설계스튜디오9_졸업설계\맵모델링\강남구청\(B010)수치지도_37705092_2022_00000597055733\N3A_C0423365.shp"
"C:\Users\BaekInchan\Desktop\설계스튜디오9_졸업설계\맵모델링\강남구청\(B010)수치지도_37705092_2022_00000597055733\N3A_C0430000.shp"
"C:\Users\BaekInchan\Desktop\설계스튜디오9_졸업설계\맵모델링\강남구청\(B010)수치지도_37705092_2022_00000597055733\N3A_G0010000.shp"
"C:\Users\BaekInchan\Desktop\설계스튜디오9_졸업설계\맵모델링\강남구청\(B010)수치지도_37705092_2022_00000597055733\N3L_A0010000.shp"
"C:\Users\BaekInchan\Desktop\설계스튜디오9_졸업설계\맵모델링\강남구청\(B010)수치지도_37705092_2022_00000597055733\N3L_A0020000.shp"
"C:\Users\BaekInchan\Desktop\설계스튜디오9_졸업설계\맵모델링\강남구청\(B010)수치지도_37705092_2022_00000597055733\N3L_A0033330.shp"
"C:\Users\BaekInchan\Desktop\설계스튜디오9_졸업설계\맵모델링\강남구청\(B010)수치지도_37705092_2022_00000597055733\N3L_B0020000.shp"
"C:\Users\BaekInchan\Desktop\설계스튜디오9_졸업설계\맵모델링\강남구청\(B010)수치지도_37705092_2022_00000597055733\N3L_C0070000.shp"
"C:\Users\BaekInchan\Desktop\설계스튜디오9_졸업설계\맵모델링\강남구청\(B010)수치지도_37705092_2022_00000597055733\N3L_C0520000.shp"
"C:\Users\BaekInchan\Desktop\설계스튜디오9_졸업설계\맵모델링\강남구청\(B010)수치지도_37705092_2022_00000597055733\N3L_E0020000.shp"
"C:\Users\BaekInchan\Desktop\설계스튜디오9_졸업설계\맵모델링\강남구청\(B010)수치지도_37705092_2022_00000597055733\N3L_F0010000.shp"
"C:\Users\BaekInchan\Desktop\설계스튜디오9_졸업설계\맵모델링\강남구청\(B010)수치지도_37705092_2022_00000597055733\N3L_F0040000.shp"
"C:\Users\BaekInchan\Desktop\설계스튜디오9_졸업설계\맵모델링\강남구청\(B010)수치지도_37705092_2022_00000597055733\N3L_G0030000.shp"
"C:\Users\BaekInchan\Desktop\설계스튜디오9_졸업설계\맵모델링\강남구청\(B010)수치지도_37705092_2022_00000597055733\N3L_H0010000.shp"
"C:\Users\BaekInchan\Desktop\설계스튜디오9_졸업설계\맵모델링\강남구청\(B010)수치지도_37705092_2022_00000597055733\N3P_A0131122.shp"
"C:\Users\BaekInchan\Desktop\설계스튜디오9_졸업설계\맵모델링\강남구청\(B010)수치지도_37705092_2022_00000597055733\N3P_C0285311.shp"
"C:\Users\BaekInchan\Desktop\설계스튜디오9_졸업설계\맵모델링\강남구청\(B010)수치지도_37705092_2022_00000597055733\N3P_C0310000.shp"
"C:\Users\BaekInchan\Desktop\설계스튜디오9_졸업설계\맵모델링\강남구청\(B010)수치지도_37705092_2022_00000597055733\N3P_C0380000.shp"
"C:\Users\BaekInchan\Desktop\설계스튜디오9_졸업설계\맵모델링\강남구청\(B010)수치지도_37705092_2022_00000597055733\N3P_F0020000.shp"
""")  # disabled
panel_18 = Panel(""""C:\Users\BaekInchan\Desktop\설계스튜디오9_졸업설계\맵모델링\논현역\(B010)수치지도_37705091_2022_00000452529185\N3P_H0040000.shp"
"C:\Users\BaekInchan\Desktop\설계스튜디오9_졸업설계\맵모델링\논현역\(B010)수치지도_37705091_2022_00000452529185\N3A_A0010000.shp"
"C:\Users\BaekInchan\Desktop\설계스튜디오9_졸업설계\맵모델링\논현역\(B010)수치지도_37705091_2022_00000452529185\N3A_A0033320.shp"
"C:\Users\BaekInchan\Desktop\설계스튜디오9_졸업설계\맵모델링\논현역\(B010)수치지도_37705091_2022_00000452529185\N3A_A0053326.shp"
"C:\Users\BaekInchan\Desktop\설계스튜디오9_졸업설계\맵모델링\논현역\(B010)수치지도_37705091_2022_00000452529185\N3A_A0063321.shp"
"C:\Users\BaekInchan\Desktop\설계스튜디오9_졸업설계\맵모델링\논현역\(B010)수치지도_37705091_2022_00000452529185\N3A_A0070000.shp"
"C:\Users\BaekInchan\Desktop\설계스튜디오9_졸업설계\맵모델링\논현역\(B010)수치지도_37705091_2022_00000452529185\N3A_A0080000.shp"
"C:\Users\BaekInchan\Desktop\설계스튜디오9_졸업설계\맵모델링\논현역\(B010)수치지도_37705091_2022_00000452529185\N3A_A0090000.shp"
"C:\Users\BaekInchan\Desktop\설계스튜디오9_졸업설계\맵모델링\논현역\(B010)수치지도_37705091_2022_00000452529185\N3A_A0100000.shp"
"C:\Users\BaekInchan\Desktop\설계스튜디오9_졸업설계\맵모델링\논현역\(B010)수치지도_37705091_2022_00000452529185\N3A_A0160024.shp"
"C:\Users\BaekInchan\Desktop\설계스튜디오9_졸업설계\맵모델링\논현역\(B010)수치지도_37705091_2022_00000452529185\N3A_B0010000.shp"
"C:\Users\BaekInchan\Desktop\설계스튜디오9_졸업설계\맵모델링\논현역\(B010)수치지도_37705091_2022_00000452529185\N3A_C0186115.shp"
"C:\Users\BaekInchan\Desktop\설계스튜디오9_졸업설계\맵모델링\논현역\(B010)수치지도_37705091_2022_00000452529185\N3A_C0390000.shp"
"C:\Users\BaekInchan\Desktop\설계스튜디오9_졸업설계\맵모델링\논현역\(B010)수치지도_37705091_2022_00000452529185\N3A_C0423365.shp"
"C:\Users\BaekInchan\Desktop\설계스튜디오9_졸업설계\맵모델링\논현역\(B010)수치지도_37705091_2022_00000452529185\N3A_C0430000.shp"
"C:\Users\BaekInchan\Desktop\설계스튜디오9_졸업설계\맵모델링\논현역\(B010)수치지도_37705091_2022_00000452529185\N3A_D0010000.shp"
"C:\Users\BaekInchan\Desktop\설계스튜디오9_졸업설계\맵모델링\논현역\(B010)수치지도_37705091_2022_00000452529185\N3A_E0010001.shp"
"C:\Users\BaekInchan\Desktop\설계스튜디오9_졸업설계\맵모델링\논현역\(B010)수치지도_37705091_2022_00000452529185\N3A_E0032111.shp"
"C:\Users\BaekInchan\Desktop\설계스튜디오9_졸업설계\맵모델링\논현역\(B010)수치지도_37705091_2022_00000452529185\N3A_E0052114.shp"
"C:\Users\BaekInchan\Desktop\설계스튜디오9_졸업설계\맵모델링\논현역\(B010)수치지도_37705091_2022_00000452529185\N3A_G0010000.shp"
"C:\Users\BaekInchan\Desktop\설계스튜디오9_졸업설계\맵모델링\논현역\(B010)수치지도_37705091_2022_00000452529185\N3A_G0020000.shp"
"C:\Users\BaekInchan\Desktop\설계스튜디오9_졸업설계\맵모델링\논현역\(B010)수치지도_37705091_2022_00000452529185\N3L_A0010000.shp"
"C:\Users\BaekInchan\Desktop\설계스튜디오9_졸업설계\맵모델링\논현역\(B010)수치지도_37705091_2022_00000452529185\N3L_A0020000.shp"
"C:\Users\BaekInchan\Desktop\설계스튜디오9_졸업설계\맵모델링\논현역\(B010)수치지도_37705091_2022_00000452529185\N3L_A0033330.shp"
"C:\Users\BaekInchan\Desktop\설계스튜디오9_졸업설계\맵모델링\논현역\(B010)수치지도_37705091_2022_00000452529185\N3L_A0150000.shp"
"C:\Users\BaekInchan\Desktop\설계스튜디오9_졸업설계\맵모델링\논현역\(B010)수치지도_37705091_2022_00000452529185\N3L_A0171119.shp"
"C:\Users\BaekInchan\Desktop\설계스튜디오9_졸업설계\맵모델링\논현역\(B010)수치지도_37705091_2022_00000452529185\N3L_B0020000.shp"
"C:\Users\BaekInchan\Desktop\설계스튜디오9_졸업설계\맵모델링\논현역\(B010)수치지도_37705091_2022_00000452529185\N3L_C0050000.shp"
"C:\Users\BaekInchan\Desktop\설계스튜디오9_졸업설계\맵모델링\논현역\(B010)수치지도_37705091_2022_00000452529185\N3L_C0060000.shp"
"C:\Users\BaekInchan\Desktop\설계스튜디오9_졸업설계\맵모델링\논현역\(B010)수치지도_37705091_2022_00000452529185\N3L_C0070000.shp"
"C:\Users\BaekInchan\Desktop\설계스튜디오9_졸업설계\맵모델링\논현역\(B010)수치지도_37705091_2022_00000452529185\N3L_C0520000.shp"
"C:\Users\BaekInchan\Desktop\설계스튜디오9_졸업설계\맵모델링\논현역\(B010)수치지도_37705091_2022_00000452529185\N3L_E0020000.shp"
"C:\Users\BaekInchan\Desktop\설계스튜디오9_졸업설계\맵모델링\논현역\(B010)수치지도_37705091_2022_00000452529185\N3L_F0010000.shp"
"C:\Users\BaekInchan\Desktop\설계스튜디오9_졸업설계\맵모델링\논현역\(B010)수치지도_37705091_2022_00000452529185\N3L_F0030000.shp"
"C:\Users\BaekInchan\Desktop\설계스튜디오9_졸업설계\맵모델링\논현역\(B010)수치지도_37705091_2022_00000452529185\N3L_F0040000.shp"
"C:\Users\BaekInchan\Desktop\설계스튜디오9_졸업설계\맵모델링\논현역\(B010)수치지도_37705091_2022_00000452529185\N3L_G0030000.shp"
"C:\Users\BaekInchan\Desktop\설계스튜디오9_졸업설계\맵모델링\논현역\(B010)수치지도_37705091_2022_00000452529185\N3L_H0010000.shp"
"C:\Users\BaekInchan\Desktop\설계스튜디오9_졸업설계\맵모델링\논현역\(B010)수치지도_37705091_2022_00000452529185\N3P_A0131122.shp"
"C:\Users\BaekInchan\Desktop\설계스튜디오9_졸업설계\맵모델링\논현역\(B010)수치지도_37705091_2022_00000452529185\N3P_C0380000.shp"
"C:\Users\BaekInchan\Desktop\설계스튜디오9_졸업설계\맵모델링\논현역\(B010)수치지도_37705091_2022_00000452529185\N3P_D0030000.shp"
"C:\Users\BaekInchan\Desktop\설계스튜디오9_졸업설계\맵모델링\논현역\(B010)수치지도_37705091_2022_00000452529185\N3P_E0042326.shp"
"C:\Users\BaekInchan\Desktop\설계스튜디오9_졸업설계\맵모델링\논현역\(B010)수치지도_37705091_2022_00000452529185\N3P_F0020000.shp"
"C:\Users\BaekInchan\Desktop\설계스튜디오9_졸업설계\맵모델링\논현역\(B010)수치지도_37705091_2022_00000452529185\N3P_H0020000.shp"
""")  # disabled
# 건물
panel_19 = Panel(""""C:\Users\BaekInchan\Desktop\설계스튜디오9_졸업설계\맵모델링\압구정\N3A_A0010000.shp"
"C:\Users\BaekInchan\Desktop\설계스튜디오9_졸업설계\맵모델링\압구정\N3A_A0033320.shp"
"C:\Users\BaekInchan\Desktop\설계스튜디오9_졸업설계\맵모델링\압구정\N3A_A0053326.shp"
"C:\Users\BaekInchan\Desktop\설계스튜디오9_졸업설계\맵모델링\압구정\N3A_A0063321.shp"
"C:\Users\BaekInchan\Desktop\설계스튜디오9_졸업설계\맵모델링\압구정\N3A_A0070000.shp"
"C:\Users\BaekInchan\Desktop\설계스튜디오9_졸업설계\맵모델링\압구정\N3A_A0080000.shp"
"C:\Users\BaekInchan\Desktop\설계스튜디오9_졸업설계\맵모델링\압구정\N3A_A0090000.shp"
"C:\Users\BaekInchan\Desktop\설계스튜디오9_졸업설계\맵모델링\압구정\N3A_A0100000.shp"
"C:\Users\BaekInchan\Desktop\설계스튜디오9_졸업설계\맵모델링\압구정\N3A_A0110020.shp"
"C:\Users\BaekInchan\Desktop\설계스튜디오9_졸업설계\맵모델링\압구정\N3A_A0160024.shp"
"C:\Users\BaekInchan\Desktop\설계스튜디오9_졸업설계\맵모델링\압구정\N3A_A0191221.shp"
"C:\Users\BaekInchan\Desktop\설계스튜디오9_졸업설계\맵모델링\압구정\N3A_A0201222.shp"
"C:\Users\BaekInchan\Desktop\설계스튜디오9_졸업설계\맵모델링\압구정\N3A_B0010000.shp"
"C:\Users\BaekInchan\Desktop\설계스튜디오9_졸업설계\맵모델링\압구정\N3A_C0186115.shp"
"C:\Users\BaekInchan\Desktop\설계스튜디오9_졸업설계\맵모델링\압구정\N3A_C0390000.shp"
"C:\Users\BaekInchan\Desktop\설계스튜디오9_졸업설계\맵모델링\압구정\N3A_C0423365.shp"
"C:\Users\BaekInchan\Desktop\설계스튜디오9_졸업설계\맵모델링\압구정\N3A_C0430000.shp"
"C:\Users\BaekInchan\Desktop\설계스튜디오9_졸업설계\맵모델링\압구정\N3A_D0010000.shp"
"C:\Users\BaekInchan\Desktop\설계스튜디오9_졸업설계\맵모델링\압구정\N3A_E0010001.shp"
"C:\Users\BaekInchan\Desktop\설계스튜디오9_졸업설계\맵모델링\압구정\N3A_E0032111.shp"
"C:\Users\BaekInchan\Desktop\설계스튜디오9_졸업설계\맵모델링\압구정\N3A_E0052114.shp"
"C:\Users\BaekInchan\Desktop\설계스튜디오9_졸업설계\맵모델링\압구정\N3A_G0010000.shp"
"C:\Users\BaekInchan\Desktop\설계스튜디오9_졸업설계\맵모델링\압구정\N3A_G0020000.shp"
"C:\Users\BaekInchan\Desktop\설계스튜디오9_졸업설계\맵모델링\압구정\N3L_A0010000.shp"
"C:\Users\BaekInchan\Desktop\설계스튜디오9_졸업설계\맵모델링\압구정\N3L_A0020000.shp"
"C:\Users\BaekInchan\Desktop\설계스튜디오9_졸업설계\맵모델링\압구정\N3L_A0033330.shp"
"C:\Users\BaekInchan\Desktop\설계스튜디오9_졸업설계\맵모델링\압구정\N3L_A0123373.shp"
"C:\Users\BaekInchan\Desktop\설계스튜디오9_졸업설계\맵모델링\압구정\N3L_A0150000.shp"
"C:\Users\BaekInchan\Desktop\설계스튜디오9_졸업설계\맵모델링\압구정\N3L_A0171119.shp"
"C:\Users\BaekInchan\Desktop\설계스튜디오9_졸업설계\맵모델링\압구정\N3L_B0020000.shp"
"C:\Users\BaekInchan\Desktop\설계스튜디오9_졸업설계\맵모델링\압구정\N3L_C0050000.shp"
"C:\Users\BaekInchan\Desktop\설계스튜디오9_졸업설계\맵모델링\압구정\N3L_C0060000.shp"
"C:\Users\BaekInchan\Desktop\설계스튜디오9_졸업설계\맵모델링\압구정\N3L_C0070000.shp"
"C:\Users\BaekInchan\Desktop\설계스튜디오9_졸업설계\맵모델링\압구정\N3L_C0520000.shp"
"C:\Users\BaekInchan\Desktop\설계스튜디오9_졸업설계\맵모델링\압구정\N3L_E0020000.shp"
"C:\Users\BaekInchan\Desktop\설계스튜디오9_졸업설계\맵모델링\압구정\N3L_F0010000.shp"
"C:\Users\BaekInchan\Desktop\설계스튜디오9_졸업설계\맵모델링\압구정\N3L_F0030000.shp"
"C:\Users\BaekInchan\Desktop\설계스튜디오9_졸업설계\맵모델링\압구정\N3L_F0040000.shp"
"C:\Users\BaekInchan\Desktop\설계스튜디오9_졸업설계\맵모델링\압구정\N3L_G0030000.shp"
"C:\Users\BaekInchan\Desktop\설계스튜디오9_졸업설계\맵모델링\압구정\N3L_H0010000.shp"
"C:\Users\BaekInchan\Desktop\설계스튜디오9_졸업설계\맵모델링\압구정\N3P_A0131122.shp"
"C:\Users\BaekInchan\Desktop\설계스튜디오9_졸업설계\맵모델링\압구정\N3P_C0210000.shp"
"C:\Users\BaekInchan\Desktop\설계스튜디오9_졸업설계\맵모델링\압구정\N3P_C0380000.shp"
"C:\Users\BaekInchan\Desktop\설계스튜디오9_졸업설계\맵모델링\압구정\N3P_D0030000.shp"
"C:\Users\BaekInchan\Desktop\설계스튜디오9_졸업설계\맵모델링\압구정\N3P_E0042326.shp"
"C:\Users\BaekInchan\Desktop\설계스튜디오9_졸업설계\맵모델링\압구정\N3P_F0020000.shp"
"C:\Users\BaekInchan\Desktop\설계스튜디오9_졸업설계\맵모델링\압구정\N3P_H0020000.shp"
"C:\Users\BaekInchan\Desktop\설계스튜디오9_졸업설계\맵모델링\압구정\N3P_H0040000.shp"
"C:\Users\BaekInchan\Desktop\설계스튜디오9_졸업설계\맵모델링\압구정\N3P_H0059153.shp"
""")
# 길
panel_20 = Panel(""""C:\Users\BaekInchan\Desktop\설계스튜디오9_졸업설계\맵모델링\압구정\N3A_A0010000.shp"
"C:\Users\BaekInchan\Desktop\설계스튜디오9_졸업설계\맵모델링\압구정\N3A_A0033320.shp"
"C:\Users\BaekInchan\Desktop\설계스튜디오9_졸업설계\맵모델링\압구정\N3A_A0053326.shp"
"C:\Users\BaekInchan\Desktop\설계스튜디오9_졸업설계\맵모델링\압구정\N3A_A0063321.shp"
"C:\Users\BaekInchan\Desktop\설계스튜디오9_졸업설계\맵모델링\압구정\N3A_A0070000.shp"
"C:\Users\BaekInchan\Desktop\설계스튜디오9_졸업설계\맵모델링\압구정\N3A_A0080000.shp"
"C:\Users\BaekInchan\Desktop\설계스튜디오9_졸업설계\맵모델링\압구정\N3A_A0090000.shp"
"C:\Users\BaekInchan\Desktop\설계스튜디오9_졸업설계\맵모델링\압구정\N3A_A0100000.shp"
"C:\Users\BaekInchan\Desktop\설계스튜디오9_졸업설계\맵모델링\압구정\N3A_A0110020.shp"
"C:\Users\BaekInchan\Desktop\설계스튜디오9_졸업설계\맵모델링\압구정\N3A_A0160024.shp"
"C:\Users\BaekInchan\Desktop\설계스튜디오9_졸업설계\맵모델링\압구정\N3A_A0191221.shp"
"C:\Users\BaekInchan\Desktop\설계스튜디오9_졸업설계\맵모델링\압구정\N3A_A0201222.shp"
"C:\Users\BaekInchan\Desktop\설계스튜디오9_졸업설계\맵모델링\압구정\N3A_B0010000.shp"
"C:\Users\BaekInchan\Desktop\설계스튜디오9_졸업설계\맵모델링\압구정\N3A_C0186115.shp"
"C:\Users\BaekInchan\Desktop\설계스튜디오9_졸업설계\맵모델링\압구정\N3A_C0390000.shp"
"C:\Users\BaekInchan\Desktop\설계스튜디오9_졸업설계\맵모델링\압구정\N3A_C0423365.shp"
"C:\Users\BaekInchan\Desktop\설계스튜디오9_졸업설계\맵모델링\압구정\N3A_C0430000.shp"
"C:\Users\BaekInchan\Desktop\설계스튜디오9_졸업설계\맵모델링\압구정\N3A_D0010000.shp"
"C:\Users\BaekInchan\Desktop\설계스튜디오9_졸업설계\맵모델링\압구정\N3A_E0010001.shp"
"C:\Users\BaekInchan\Desktop\설계스튜디오9_졸업설계\맵모델링\압구정\N3A_E0032111.shp"
"C:\Users\BaekInchan\Desktop\설계스튜디오9_졸업설계\맵모델링\압구정\N3A_E0052114.shp"
"C:\Users\BaekInchan\Desktop\설계스튜디오9_졸업설계\맵모델링\압구정\N3A_G0010000.shp"
"C:\Users\BaekInchan\Desktop\설계스튜디오9_졸업설계\맵모델링\압구정\N3A_G0020000.shp"
"C:\Users\BaekInchan\Desktop\설계스튜디오9_졸업설계\맵모델링\압구정\N3L_A0010000.shp"
"C:\Users\BaekInchan\Desktop\설계스튜디오9_졸업설계\맵모델링\압구정\N3L_A0020000.shp"
"C:\Users\BaekInchan\Desktop\설계스튜디오9_졸업설계\맵모델링\압구정\N3L_A0033330.shp"
"C:\Users\BaekInchan\Desktop\설계스튜디오9_졸업설계\맵모델링\압구정\N3L_A0123373.shp"
"C:\Users\BaekInchan\Desktop\설계스튜디오9_졸업설계\맵모델링\압구정\N3L_A0150000.shp"
"C:\Users\BaekInchan\Desktop\설계스튜디오9_졸업설계\맵모델링\압구정\N3L_A0171119.shp"
"C:\Users\BaekInchan\Desktop\설계스튜디오9_졸업설계\맵모델링\압구정\N3L_B0020000.shp"
"C:\Users\BaekInchan\Desktop\설계스튜디오9_졸업설계\맵모델링\압구정\N3L_C0050000.shp"
"C:\Users\BaekInchan\Desktop\설계스튜디오9_졸업설계\맵모델링\압구정\N3L_C0060000.shp"
"C:\Users\BaekInchan\Desktop\설계스튜디오9_졸업설계\맵모델링\압구정\N3L_C0070000.shp"
"C:\Users\BaekInchan\Desktop\설계스튜디오9_졸업설계\맵모델링\압구정\N3L_C0520000.shp"
"C:\Users\BaekInchan\Desktop\설계스튜디오9_졸업설계\맵모델링\압구정\N3L_E0020000.shp"
"C:\Users\BaekInchan\Desktop\설계스튜디오9_졸업설계\맵모델링\압구정\N3L_F0010000.shp"
"C:\Users\BaekInchan\Desktop\설계스튜디오9_졸업설계\맵모델링\압구정\N3L_F0030000.shp"
"C:\Users\BaekInchan\Desktop\설계스튜디오9_졸업설계\맵모델링\압구정\N3L_F0040000.shp"
"C:\Users\BaekInchan\Desktop\설계스튜디오9_졸업설계\맵모델링\압구정\N3L_G0030000.shp"
"C:\Users\BaekInchan\Desktop\설계스튜디오9_졸업설계\맵모델링\압구정\N3L_H0010000.shp"
"C:\Users\BaekInchan\Desktop\설계스튜디오9_졸업설계\맵모델링\압구정\N3P_A0131122.shp"
"C:\Users\BaekInchan\Desktop\설계스튜디오9_졸업설계\맵모델링\압구정\N3P_C0210000.shp"
"C:\Users\BaekInchan\Desktop\설계스튜디오9_졸업설계\맵모델링\압구정\N3P_C0380000.shp"
"C:\Users\BaekInchan\Desktop\설계스튜디오9_졸업설계\맵모델링\압구정\N3P_D0030000.shp"
"C:\Users\BaekInchan\Desktop\설계스튜디오9_졸업설계\맵모델링\압구정\N3P_E0042326.shp"
"C:\Users\BaekInchan\Desktop\설계스튜디오9_졸업설계\맵모델링\압구정\N3P_F0020000.shp"
"C:\Users\BaekInchan\Desktop\설계스튜디오9_졸업설계\맵모델링\압구정\N3P_H0020000.shp"
"C:\Users\BaekInchan\Desktop\설계스튜디오9_졸업설계\맵모델링\압구정\N3P_H0040000.shp"
"C:\Users\BaekInchan\Desktop\설계스튜디오9_졸업설계\맵모델링\압구정\N3P_H0059153.shp"
""")  # disabled
panel_21 = Panel(""""C:\Users\BaekInchan\Desktop\설계스튜디오9_졸업설계\맵모델링\신사\N3P_H0059153.shp"
"C:\Users\BaekInchan\Desktop\설계스튜디오9_졸업설계\맵모델링\신사\N3A_A0010000.shp"
"C:\Users\BaekInchan\Desktop\설계스튜디오9_졸업설계\맵모델링\신사\N3A_A0033320.shp"
"C:\Users\BaekInchan\Desktop\설계스튜디오9_졸업설계\맵모델링\신사\N3A_A0053326.shp"
"C:\Users\BaekInchan\Desktop\설계스튜디오9_졸업설계\맵모델링\신사\N3A_A0063321.shp"
"C:\Users\BaekInchan\Desktop\설계스튜디오9_졸업설계\맵모델링\신사\N3A_A0070000.shp"
"C:\Users\BaekInchan\Desktop\설계스튜디오9_졸업설계\맵모델링\신사\N3A_A0080000.shp"
"C:\Users\BaekInchan\Desktop\설계스튜디오9_졸업설계\맵모델링\신사\N3A_A0090000.shp"
"C:\Users\BaekInchan\Desktop\설계스튜디오9_졸업설계\맵모델링\신사\N3A_A0100000.shp"
"C:\Users\BaekInchan\Desktop\설계스튜디오9_졸업설계\맵모델링\신사\N3A_A0110020.shp"
"C:\Users\BaekInchan\Desktop\설계스튜디오9_졸업설계\맵모델링\신사\N3A_A0160024.shp"
"C:\Users\BaekInchan\Desktop\설계스튜디오9_졸업설계\맵모델링\신사\N3A_A0191221.shp"
"C:\Users\BaekInchan\Desktop\설계스튜디오9_졸업설계\맵모델링\신사\N3A_A0201222.shp"
"C:\Users\BaekInchan\Desktop\설계스튜디오9_졸업설계\맵모델링\신사\N3A_B0010000.shp"
"C:\Users\BaekInchan\Desktop\설계스튜디오9_졸업설계\맵모델링\신사\N3A_C0186115.shp"
"C:\Users\BaekInchan\Desktop\설계스튜디오9_졸업설계\맵모델링\신사\N3A_C0390000.shp"
"C:\Users\BaekInchan\Desktop\설계스튜디오9_졸업설계\맵모델링\신사\N3A_C0423365.shp"
"C:\Users\BaekInchan\Desktop\설계스튜디오9_졸업설계\맵모델링\신사\N3A_C0430000.shp"
"C:\Users\BaekInchan\Desktop\설계스튜디오9_졸업설계\맵모델링\신사\N3A_D0010000.shp"
"C:\Users\BaekInchan\Desktop\설계스튜디오9_졸업설계\맵모델링\신사\N3A_E0010001.shp"
"C:\Users\BaekInchan\Desktop\설계스튜디오9_졸업설계\맵모델링\신사\N3A_E0032111.shp"
"C:\Users\BaekInchan\Desktop\설계스튜디오9_졸업설계\맵모델링\신사\N3A_E0052114.shp"
"C:\Users\BaekInchan\Desktop\설계스튜디오9_졸업설계\맵모델링\신사\N3A_G0010000.shp"
"C:\Users\BaekInchan\Desktop\설계스튜디오9_졸업설계\맵모델링\신사\N3A_G0020000.shp"
"C:\Users\BaekInchan\Desktop\설계스튜디오9_졸업설계\맵모델링\신사\N3L_A0010000.shp"
"C:\Users\BaekInchan\Desktop\설계스튜디오9_졸업설계\맵모델링\신사\N3L_A0020000.shp"
"C:\Users\BaekInchan\Desktop\설계스튜디오9_졸업설계\맵모델링\신사\N3L_A0033320.shp"
"C:\Users\BaekInchan\Desktop\설계스튜디오9_졸업설계\맵모델링\신사\N3L_A0123373.shp"
"C:\Users\BaekInchan\Desktop\설계스튜디오9_졸업설계\맵모델링\신사\N3L_A0150000.shp"
"C:\Users\BaekInchan\Desktop\설계스튜디오9_졸업설계\맵모델링\신사\N3L_A0171119.shp"
"C:\Users\BaekInchan\Desktop\설계스튜디오9_졸업설계\맵모델링\신사\N3L_B0020000.shp"
"C:\Users\BaekInchan\Desktop\설계스튜디오9_졸업설계\맵모델링\신사\N3L_C0050000.shp"
"C:\Users\BaekInchan\Desktop\설계스튜디오9_졸업설계\맵모델링\신사\N3L_C0060000.shp"
"C:\Users\BaekInchan\Desktop\설계스튜디오9_졸업설계\맵모델링\신사\N3L_C0520000.shp"
"C:\Users\BaekInchan\Desktop\설계스튜디오9_졸업설계\맵모델링\신사\N3L_E0020000.shp"
"C:\Users\BaekInchan\Desktop\설계스튜디오9_졸업설계\맵모델링\신사\N3L_F0010000.shp"
"C:\Users\BaekInchan\Desktop\설계스튜디오9_졸업설계\맵모델링\신사\N3L_F0030000.shp"
"C:\Users\BaekInchan\Desktop\설계스튜디오9_졸업설계\맵모델링\신사\N3L_F0040000.shp"
"C:\Users\BaekInchan\Desktop\설계스튜디오9_졸업설계\맵모델링\신사\N3L_G0030000.shp"
"C:\Users\BaekInchan\Desktop\설계스튜디오9_졸업설계\맵모델링\신사\N3L_H0010000.shp"
"C:\Users\BaekInchan\Desktop\설계스튜디오9_졸업설계\맵모델링\신사\N3P_A0131122.shp"
"C:\Users\BaekInchan\Desktop\설계스튜디오9_졸업설계\맵모델링\신사\N3P_C0380000.shp"
"C:\Users\BaekInchan\Desktop\설계스튜디오9_졸업설계\맵모델링\신사\N3P_E0042326.shp"
"C:\Users\BaekInchan\Desktop\설계스튜디오9_졸업설계\맵모델링\신사\N3P_F0020000.shp"
"C:\Users\BaekInchan\Desktop\설계스튜디오9_졸업설계\맵모델링\신사\N3P_H0020000.shp"
"C:\Users\BaekInchan\Desktop\설계스튜디오9_졸업설계\맵모델링\신사\N3P_H0040000.shp"
""")  # disabled
panel_22 = Panel(""""C:\Users\BaekInchan\Desktop\설계스튜디오9_졸업설계\맵모델링\신사\N3P_H0059153.shp"
"C:\Users\BaekInchan\Desktop\설계스튜디오9_졸업설계\맵모델링\신사\N3A_A0010000.shp"
"C:\Users\BaekInchan\Desktop\설계스튜디오9_졸업설계\맵모델링\신사\N3A_A0033320.shp"
"C:\Users\BaekInchan\Desktop\설계스튜디오9_졸업설계\맵모델링\신사\N3A_A0053326.shp"
"C:\Users\BaekInchan\Desktop\설계스튜디오9_졸업설계\맵모델링\신사\N3A_A0063321.shp"
"C:\Users\BaekInchan\Desktop\설계스튜디오9_졸업설계\맵모델링\신사\N3A_A0070000.shp"
"C:\Users\BaekInchan\Desktop\설계스튜디오9_졸업설계\맵모델링\신사\N3A_A0080000.shp"
"C:\Users\BaekInchan\Desktop\설계스튜디오9_졸업설계\맵모델링\신사\N3A_A0090000.shp"
"C:\Users\BaekInchan\Desktop\설계스튜디오9_졸업설계\맵모델링\신사\N3A_A0100000.shp"
"C:\Users\BaekInchan\Desktop\설계스튜디오9_졸업설계\맵모델링\신사\N3A_A0110020.shp"
"C:\Users\BaekInchan\Desktop\설계스튜디오9_졸업설계\맵모델링\신사\N3A_A0160024.shp"
"C:\Users\BaekInchan\Desktop\설계스튜디오9_졸업설계\맵모델링\신사\N3A_A0191221.shp"
"C:\Users\BaekInchan\Desktop\설계스튜디오9_졸업설계\맵모델링\신사\N3A_A0201222.shp"
"C:\Users\BaekInchan\Desktop\설계스튜디오9_졸업설계\맵모델링\신사\N3A_B0010000.shp"
"C:\Users\BaekInchan\Desktop\설계스튜디오9_졸업설계\맵모델링\신사\N3A_C0186115.shp"
"C:\Users\BaekInchan\Desktop\설계스튜디오9_졸업설계\맵모델링\신사\N3A_C0390000.shp"
"C:\Users\BaekInchan\Desktop\설계스튜디오9_졸업설계\맵모델링\신사\N3A_C0423365.shp"
"C:\Users\BaekInchan\Desktop\설계스튜디오9_졸업설계\맵모델링\신사\N3A_C0430000.shp"
"C:\Users\BaekInchan\Desktop\설계스튜디오9_졸업설계\맵모델링\신사\N3A_D0010000.shp"
"C:\Users\BaekInchan\Desktop\설계스튜디오9_졸업설계\맵모델링\신사\N3A_E0010001.shp"
"C:\Users\BaekInchan\Desktop\설계스튜디오9_졸업설계\맵모델링\신사\N3A_E0032111.shp"
"C:\Users\BaekInchan\Desktop\설계스튜디오9_졸업설계\맵모델링\신사\N3A_E0052114.shp"
"C:\Users\BaekInchan\Desktop\설계스튜디오9_졸업설계\맵모델링\신사\N3A_G0010000.shp"
"C:\Users\BaekInchan\Desktop\설계스튜디오9_졸업설계\맵모델링\신사\N3A_G0020000.shp"
"C:\Users\BaekInchan\Desktop\설계스튜디오9_졸업설계\맵모델링\신사\N3L_A0010000.shp"
"C:\Users\BaekInchan\Desktop\설계스튜디오9_졸업설계\맵모델링\신사\N3L_A0020000.shp"
"C:\Users\BaekInchan\Desktop\설계스튜디오9_졸업설계\맵모델링\신사\N3L_A0033320.shp"
"C:\Users\BaekInchan\Desktop\설계스튜디오9_졸업설계\맵모델링\신사\N3L_A0123373.shp"
"C:\Users\BaekInchan\Desktop\설계스튜디오9_졸업설계\맵모델링\신사\N3L_A0150000.shp"
"C:\Users\BaekInchan\Desktop\설계스튜디오9_졸업설계\맵모델링\신사\N3L_A0171119.shp"
"C:\Users\BaekInchan\Desktop\설계스튜디오9_졸업설계\맵모델링\신사\N3L_B0020000.shp"
"C:\Users\BaekInchan\Desktop\설계스튜디오9_졸업설계\맵모델링\신사\N3L_C0050000.shp"
"C:\Users\BaekInchan\Desktop\설계스튜디오9_졸업설계\맵모델링\신사\N3L_C0060000.shp"
"C:\Users\BaekInchan\Desktop\설계스튜디오9_졸업설계\맵모델링\신사\N3L_C0520000.shp"
"C:\Users\BaekInchan\Desktop\설계스튜디오9_졸업설계\맵모델링\신사\N3L_E0020000.shp"
"C:\Users\BaekInchan\Desktop\설계스튜디오9_졸업설계\맵모델링\신사\N3L_F0010000.shp"
"C:\Users\BaekInchan\Desktop\설계스튜디오9_졸업설계\맵모델링\신사\N3L_F0030000.shp"
"C:\Users\BaekInchan\Desktop\설계스튜디오9_졸업설계\맵모델링\신사\N3L_F0040000.shp"
"C:\Users\BaekInchan\Desktop\설계스튜디오9_졸업설계\맵모델링\신사\N3L_G0030000.shp"
"C:\Users\BaekInchan\Desktop\설계스튜디오9_졸업설계\맵모델링\신사\N3L_H0010000.shp"
"C:\Users\BaekInchan\Desktop\설계스튜디오9_졸업설계\맵모델링\신사\N3P_A0131122.shp"
"C:\Users\BaekInchan\Desktop\설계스튜디오9_졸업설계\맵모델링\신사\N3P_C0380000.shp"
"C:\Users\BaekInchan\Desktop\설계스튜디오9_졸업설계\맵모델링\신사\N3P_E0042326.shp"
"C:\Users\BaekInchan\Desktop\설계스튜디오9_졸업설계\맵모델링\신사\N3P_F0020000.shp"
"C:\Users\BaekInchan\Desktop\설계스튜디오9_졸업설계\맵모델링\신사\N3P_H0020000.shp"
"C:\Users\BaekInchan\Desktop\설계스튜디오9_졸업설계\맵모델링\신사\N3P_H0040000.shp"
""")  # disabled
panel_23 = Panel(""""C:\Users\BaekInchan\Desktop\설계스튜디오9_졸업설계\맵모델링\강남구청\(B010)수치지도_37705092_2022_00000597055733\N3P_H0040000.shp"
"C:\Users\BaekInchan\Desktop\설계스튜디오9_졸업설계\맵모델링\강남구청\(B010)수치지도_37705092_2022_00000597055733\N3A_A0010000.shp"
"C:\Users\BaekInchan\Desktop\설계스튜디오9_졸업설계\맵모델링\강남구청\(B010)수치지도_37705092_2022_00000597055733\N3A_A0033320.shp"
"C:\Users\BaekInchan\Desktop\설계스튜디오9_졸업설계\맵모델링\강남구청\(B010)수치지도_37705092_2022_00000597055733\N3A_A0053326.shp"
"C:\Users\BaekInchan\Desktop\설계스튜디오9_졸업설계\맵모델링\강남구청\(B010)수치지도_37705092_2022_00000597055733\N3A_A0080000.shp"
"C:\Users\BaekInchan\Desktop\설계스튜디오9_졸업설계\맵모델링\강남구청\(B010)수치지도_37705092_2022_00000597055733\N3A_B0010000.shp"
"C:\Users\BaekInchan\Desktop\설계스튜디오9_졸업설계\맵모델링\강남구청\(B010)수치지도_37705092_2022_00000597055733\N3A_C0186115.shp"
"C:\Users\BaekInchan\Desktop\설계스튜디오9_졸업설계\맵모델링\강남구청\(B010)수치지도_37705092_2022_00000597055733\N3A_C0305316.shp"
"C:\Users\BaekInchan\Desktop\설계스튜디오9_졸업설계\맵모델링\강남구청\(B010)수치지도_37705092_2022_00000597055733\N3A_C0390000.shp"
"C:\Users\BaekInchan\Desktop\설계스튜디오9_졸업설계\맵모델링\강남구청\(B010)수치지도_37705092_2022_00000597055733\N3A_C0423365.shp"
"C:\Users\BaekInchan\Desktop\설계스튜디오9_졸업설계\맵모델링\강남구청\(B010)수치지도_37705092_2022_00000597055733\N3A_C0430000.shp"
"C:\Users\BaekInchan\Desktop\설계스튜디오9_졸업설계\맵모델링\강남구청\(B010)수치지도_37705092_2022_00000597055733\N3A_G0010000.shp"
"C:\Users\BaekInchan\Desktop\설계스튜디오9_졸업설계\맵모델링\강남구청\(B010)수치지도_37705092_2022_00000597055733\N3L_A0010000.shp"
"C:\Users\BaekInchan\Desktop\설계스튜디오9_졸업설계\맵모델링\강남구청\(B010)수치지도_37705092_2022_00000597055733\N3L_A0020000.shp"
"C:\Users\BaekInchan\Desktop\설계스튜디오9_졸업설계\맵모델링\강남구청\(B010)수치지도_37705092_2022_00000597055733\N3L_A0033330.shp"
"C:\Users\BaekInchan\Desktop\설계스튜디오9_졸업설계\맵모델링\강남구청\(B010)수치지도_37705092_2022_00000597055733\N3L_B0020000.shp"
"C:\Users\BaekInchan\Desktop\설계스튜디오9_졸업설계\맵모델링\강남구청\(B010)수치지도_37705092_2022_00000597055733\N3L_C0070000.shp"
"C:\Users\BaekInchan\Desktop\설계스튜디오9_졸업설계\맵모델링\강남구청\(B010)수치지도_37705092_2022_00000597055733\N3L_C0520000.shp"
"C:\Users\BaekInchan\Desktop\설계스튜디오9_졸업설계\맵모델링\강남구청\(B010)수치지도_37705092_2022_00000597055733\N3L_E0020000.shp"
"C:\Users\BaekInchan\Desktop\설계스튜디오9_졸업설계\맵모델링\강남구청\(B010)수치지도_37705092_2022_00000597055733\N3L_F0010000.shp"
"C:\Users\BaekInchan\Desktop\설계스튜디오9_졸업설계\맵모델링\강남구청\(B010)수치지도_37705092_2022_00000597055733\N3L_F0040000.shp"
"C:\Users\BaekInchan\Desktop\설계스튜디오9_졸업설계\맵모델링\강남구청\(B010)수치지도_37705092_2022_00000597055733\N3L_G0030000.shp"
"C:\Users\BaekInchan\Desktop\설계스튜디오9_졸업설계\맵모델링\강남구청\(B010)수치지도_37705092_2022_00000597055733\N3L_H0010000.shp"
"C:\Users\BaekInchan\Desktop\설계스튜디오9_졸업설계\맵모델링\강남구청\(B010)수치지도_37705092_2022_00000597055733\N3P_A0131122.shp"
"C:\Users\BaekInchan\Desktop\설계스튜디오9_졸업설계\맵모델링\강남구청\(B010)수치지도_37705092_2022_00000597055733\N3P_C0285311.shp"
"C:\Users\BaekInchan\Desktop\설계스튜디오9_졸업설계\맵모델링\강남구청\(B010)수치지도_37705092_2022_00000597055733\N3P_C0310000.shp"
"C:\Users\BaekInchan\Desktop\설계스튜디오9_졸업설계\맵모델링\강남구청\(B010)수치지도_37705092_2022_00000597055733\N3P_C0380000.shp"
"C:\Users\BaekInchan\Desktop\설계스튜디오9_졸업설계\맵모델링\강남구청\(B010)수치지도_37705092_2022_00000597055733\N3P_F0020000.shp"
""")  # disabled
panel_24 = Panel(""""C:\Users\BaekInchan\Desktop\설계스튜디오9_졸업설계\맵모델링\논현역\(B010)수치지도_37705091_2022_00000452529185\N3P_H0040000.shp"
"C:\Users\BaekInchan\Desktop\설계스튜디오9_졸업설계\맵모델링\논현역\(B010)수치지도_37705091_2022_00000452529185\N3A_A0010000.shp"
"C:\Users\BaekInchan\Desktop\설계스튜디오9_졸업설계\맵모델링\논현역\(B010)수치지도_37705091_2022_00000452529185\N3A_A0033320.shp"
"C:\Users\BaekInchan\Desktop\설계스튜디오9_졸업설계\맵모델링\논현역\(B010)수치지도_37705091_2022_00000452529185\N3A_A0053326.shp"
"C:\Users\BaekInchan\Desktop\설계스튜디오9_졸업설계\맵모델링\논현역\(B010)수치지도_37705091_2022_00000452529185\N3A_A0063321.shp"
"C:\Users\BaekInchan\Desktop\설계스튜디오9_졸업설계\맵모델링\논현역\(B010)수치지도_37705091_2022_00000452529185\N3A_A0070000.shp"
"C:\Users\BaekInchan\Desktop\설계스튜디오9_졸업설계\맵모델링\논현역\(B010)수치지도_37705091_2022_00000452529185\N3A_A0080000.shp"
"C:\Users\BaekInchan\Desktop\설계스튜디오9_졸업설계\맵모델링\논현역\(B010)수치지도_37705091_2022_00000452529185\N3A_A0090000.shp"
"C:\Users\BaekInchan\Desktop\설계스튜디오9_졸업설계\맵모델링\논현역\(B010)수치지도_37705091_2022_00000452529185\N3A_A0100000.shp"
"C:\Users\BaekInchan\Desktop\설계스튜디오9_졸업설계\맵모델링\논현역\(B010)수치지도_37705091_2022_00000452529185\N3A_A0160024.shp"
"C:\Users\BaekInchan\Desktop\설계스튜디오9_졸업설계\맵모델링\논현역\(B010)수치지도_37705091_2022_00000452529185\N3A_B0010000.shp"
"C:\Users\BaekInchan\Desktop\설계스튜디오9_졸업설계\맵모델링\논현역\(B010)수치지도_37705091_2022_00000452529185\N3A_C0186115.shp"
"C:\Users\BaekInchan\Desktop\설계스튜디오9_졸업설계\맵모델링\논현역\(B010)수치지도_37705091_2022_00000452529185\N3A_C0390000.shp"
"C:\Users\BaekInchan\Desktop\설계스튜디오9_졸업설계\맵모델링\논현역\(B010)수치지도_37705091_2022_00000452529185\N3A_C0423365.shp"
"C:\Users\BaekInchan\Desktop\설계스튜디오9_졸업설계\맵모델링\논현역\(B010)수치지도_37705091_2022_00000452529185\N3A_C0430000.shp"
"C:\Users\BaekInchan\Desktop\설계스튜디오9_졸업설계\맵모델링\논현역\(B010)수치지도_37705091_2022_00000452529185\N3A_D0010000.shp"
"C:\Users\BaekInchan\Desktop\설계스튜디오9_졸업설계\맵모델링\논현역\(B010)수치지도_37705091_2022_00000452529185\N3A_E0010001.shp"
"C:\Users\BaekInchan\Desktop\설계스튜디오9_졸업설계\맵모델링\논현역\(B010)수치지도_37705091_2022_00000452529185\N3A_E0032111.shp"
"C:\Users\BaekInchan\Desktop\설계스튜디오9_졸업설계\맵모델링\논현역\(B010)수치지도_37705091_2022_00000452529185\N3A_E0052114.shp"
"C:\Users\BaekInchan\Desktop\설계스튜디오9_졸업설계\맵모델링\논현역\(B010)수치지도_37705091_2022_00000452529185\N3A_G0010000.shp"
"C:\Users\BaekInchan\Desktop\설계스튜디오9_졸업설계\맵모델링\논현역\(B010)수치지도_37705091_2022_00000452529185\N3A_G0020000.shp"
"C:\Users\BaekInchan\Desktop\설계스튜디오9_졸업설계\맵모델링\논현역\(B010)수치지도_37705091_2022_00000452529185\N3L_A0010000.shp"
"C:\Users\BaekInchan\Desktop\설계스튜디오9_졸업설계\맵모델링\논현역\(B010)수치지도_37705091_2022_00000452529185\N3L_A0020000.shp"
"C:\Users\BaekInchan\Desktop\설계스튜디오9_졸업설계\맵모델링\논현역\(B010)수치지도_37705091_2022_00000452529185\N3L_A0033330.shp"
"C:\Users\BaekInchan\Desktop\설계스튜디오9_졸업설계\맵모델링\논현역\(B010)수치지도_37705091_2022_00000452529185\N3L_A0150000.shp"
"C:\Users\BaekInchan\Desktop\설계스튜디오9_졸업설계\맵모델링\논현역\(B010)수치지도_37705091_2022_00000452529185\N3L_A0171119.shp"
"C:\Users\BaekInchan\Desktop\설계스튜디오9_졸업설계\맵모델링\논현역\(B010)수치지도_37705091_2022_00000452529185\N3L_B0020000.shp"
"C:\Users\BaekInchan\Desktop\설계스튜디오9_졸업설계\맵모델링\논현역\(B010)수치지도_37705091_2022_00000452529185\N3L_C0050000.shp"
"C:\Users\BaekInchan\Desktop\설계스튜디오9_졸업설계\맵모델링\논현역\(B010)수치지도_37705091_2022_00000452529185\N3L_C0060000.shp"
"C:\Users\BaekInchan\Desktop\설계스튜디오9_졸업설계\맵모델링\논현역\(B010)수치지도_37705091_2022_00000452529185\N3L_C0070000.shp"
"C:\Users\BaekInchan\Desktop\설계스튜디오9_졸업설계\맵모델링\논현역\(B010)수치지도_37705091_2022_00000452529185\N3L_C0520000.shp"
"C:\Users\BaekInchan\Desktop\설계스튜디오9_졸업설계\맵모델링\논현역\(B010)수치지도_37705091_2022_00000452529185\N3L_E0020000.shp"
"C:\Users\BaekInchan\Desktop\설계스튜디오9_졸업설계\맵모델링\논현역\(B010)수치지도_37705091_2022_00000452529185\N3L_F0010000.shp"
"C:\Users\BaekInchan\Desktop\설계스튜디오9_졸업설계\맵모델링\논현역\(B010)수치지도_37705091_2022_00000452529185\N3L_F0030000.shp"
"C:\Users\BaekInchan\Desktop\설계스튜디오9_졸업설계\맵모델링\논현역\(B010)수치지도_37705091_2022_00000452529185\N3L_F0040000.shp"
"C:\Users\BaekInchan\Desktop\설계스튜디오9_졸업설계\맵모델링\논현역\(B010)수치지도_37705091_2022_00000452529185\N3L_G0030000.shp"
"C:\Users\BaekInchan\Desktop\설계스튜디오9_졸업설계\맵모델링\논현역\(B010)수치지도_37705091_2022_00000452529185\N3L_H0010000.shp"
"C:\Users\BaekInchan\Desktop\설계스튜디오9_졸업설계\맵모델링\논현역\(B010)수치지도_37705091_2022_00000452529185\N3P_A0131122.shp"
"C:\Users\BaekInchan\Desktop\설계스튜디오9_졸업설계\맵모델링\논현역\(B010)수치지도_37705091_2022_00000452529185\N3P_C0380000.shp"
"C:\Users\BaekInchan\Desktop\설계스튜디오9_졸업설계\맵모델링\논현역\(B010)수치지도_37705091_2022_00000452529185\N3P_D0030000.shp"
"C:\Users\BaekInchan\Desktop\설계스튜디오9_졸업설계\맵모델링\논현역\(B010)수치지도_37705091_2022_00000452529185\N3P_E0042326.shp"
"C:\Users\BaekInchan\Desktop\설계스튜디오9_졸업설계\맵모델링\논현역\(B010)수치지도_37705091_2022_00000452529185\N3P_F0020000.shp"
"C:\Users\BaekInchan\Desktop\설계스튜디오9_졸업설계\맵모델링\논현역\(B010)수치지도_37705091_2022_00000452529185\N3P_H0020000.shp"
""")  # disabled
panel_25 = Panel("N3A_B0010000")  # disabled
panel_26 = Panel("N3A_E0010001")  # disabled
panel_27 = Panel("A0010000")  # disabled
toggle = BooleanToggle(True)
toggle_2 = BooleanToggle(True)
toggle_3 = BooleanToggle(True)
toggle_4 = BooleanToggle(True)
python = GhPythonScript(x="N3L_A003", shapeFile=panel)  # -> out, a, ans; inputs shapeFile: list
# ---------- python: Python ----------
__author__ = "BaekInchan"
__version__ = "2024.03.23"

import rhinoscriptsyntax as rs


a = []

for i in shapeFile : 
    if(i[0] == '"') : i = i[1 :]
    if(i[-1] == '"') : i = i[:-1]
    #if(i.split("\\")[-1].split("_")[0][-1] == 'P') : continue; 
    a.append(i)

ans = ""

for i in a : 
    if x in i : 
        ans = i
        break
# ---------- end python ----------
python_2 = GhPythonScript(x="N3L_A003", shapeFile=panel_2)  # -> out, a, ans; inputs shapeFile: list; same code as python
python_3 = GhPythonScript(x="N3L_A003", shapeFile=panel_3)  # -> out, a, ans; inputs shapeFile: list; same code as python
python_4 = GhPythonScript(x="N3L_A003", shapeFile=panel_4)  # -> out, a, ans; inputs shapeFile: list; same code as python
toggle_5 = BooleanToggle(True)  # disabled
toggle_6 = BooleanToggle(True)
toggle_7 = BooleanToggle(True)  # disabled
toggle_8 = BooleanToggle(True)  # disabled
toggle_9 = BooleanToggle(True)  # disabled
toggle_10 = BooleanToggle(True)
toggle_11 = BooleanToggle(True)
toggle_12 = BooleanToggle(True)
python_5 = GhPythonScript(x=panel_26, shapeFile=panel_5)  # -> out, a, ans; inputs shapeFile: list; disabled; same code as python
python_6 = GhPythonScript(x=panel_26, shapeFile=panel_6)  # -> out, a, ans; inputs shapeFile: list; disabled; same code as python
number_slider = Slider(5, range=0..100)  # disabled
python_7 = GhPythonScript(x=panel_26, shapeFile=panel_7)  # -> out, a, ans; inputs shapeFile: list; disabled; same code as python
number_slider_2 = Slider(5, range=0..100)  # disabled
python_8 = GhPythonScript(x=panel_26, shapeFile=panel_8)  # -> out, a, ans; inputs shapeFile: list; disabled; same code as python
number_slider_3 = Slider(5, range=0..100)  # disabled
python_9 = GhPythonScript(x="N3L_A0020000", shapeFile=panel_9)  # -> out, a, ans; inputs shapeFile: list; same code as python
python_10 = GhPythonScript(x="N3L_A0020000", shapeFile=panel_11)  # -> out, a, ans; inputs shapeFile: list; same code as python
python_11 = GhPythonScript(x="N3L_A0020000", shapeFile=panel_10)  # -> out, a, ans; inputs shapeFile: list; same code as python
python_12 = GhPythonScript(x="N3L_A0020000", shapeFile=panel_12)  # -> out, a, ans; inputs shapeFile: list; same code as python
panel_28 = Panel("N3L_F0010000")  # disabled
python_13 = GhPythonScript(x=panel_25, shapeFile=panel_19)  # -> out, a, ans; inputs shapeFile: list; same code as python
toggle_13 = BooleanToggle(True)
toggle_14 = BooleanToggle(True)  # disabled
toggle_15 = BooleanToggle(True)  # disabled
number_slider_4 = Slider(5, range=0..100)  # disabled
toggle_16 = BooleanToggle(True)  # disabled
toggle_17 = BooleanToggle(True)  # disabled
toggle_18 = BooleanToggle(True)  # disabled
number_slider_5 = Slider(5, range=0..100)  # disabled
number_slider_6 = Slider(5, range=0..100)  # disabled
number_slider_7 = Slider(5, range=0..100)  # disabled
python_14 = GhPythonScript(x=panel_27, shapeFile=panel_20)  # -> out, a, ans; inputs shapeFile: list; disabled; same code as python
python_15 = GhPythonScript(x=panel_27, shapeFile=panel_22)  # -> out, a, ans; inputs shapeFile: list; disabled; same code as python
python_16 = GhPythonScript(x=panel_27, shapeFile=panel_23)  # -> out, a, ans; inputs shapeFile: list; disabled; same code as python
python_17 = GhPythonScript(x=panel_27, shapeFile=panel_24)  # -> out, a, ans; inputs shapeFile: list; disabled; same code as python
python_18 = GhPythonScript(x=panel_25, shapeFile=panel_13)  # -> out, a, ans; inputs shapeFile: list; disabled; same code as python
number_slider_8 = Slider(5, range=0..10)  # disabled
python_19 = GhPythonScript(x=panel_25, shapeFile=panel_14)  # -> out, a, ans; inputs shapeFile: list; disabled; same code as python
python_20 = GhPythonScript(x=panel_25, shapeFile=panel_15)  # -> out, a, ans; inputs shapeFile: list; disabled; same code as python
imp_it = ImpIt(ShapefileShpPath=python.ans, Project2WGS84=False, TrueOrFalse=toggle)  # -> Shapes, Features
imp_it_2 = ImpIt(ShapefileShpPath=python_2.ans, Project2WGS84=False, TrueOrFalse=toggle_2)  # -> Shapes, Features
imp_it_3 = ImpIt(ShapefileShpPath=python_3.ans, Project2WGS84=False, TrueOrFalse=toggle_3)  # -> Shapes, Features
imp_it_4 = ImpIt(ShapefileShpPath=python_4.ans, Project2WGS84=False, TrueOrFalse=toggle_4)  # -> Shapes, Features
number_slider_9 = Slider(5, range=0..10)  # disabled
python_21 = GhPythonScript(x=panel_28, shapeFile=panel_18)  # -> out, a, ans; inputs shapeFile: list; disabled; same code as python
imp_it_5 = ImpIt(ShapefileShpPath=python_5.ans, Project2WGS84=False, TrueOrFalse=toggle_5)  # -> Shapes, Features; disabled
imp_it_6 = ImpIt(ShapefileShpPath=python_9.ans, Project2WGS84=False, TrueOrFalse=toggle_6)  # -> Shapes, Features
imp_it_7 = ImpIt(ShapefileShpPath=python_6.ans, Project2WGS84=False, TrueOrFalse=toggle_7)  # -> Shapes, Features; disabled
imp_it_8 = ImpIt(ShapefileShpPath=python_7.ans, Project2WGS84=False, TrueOrFalse=toggle_8)  # -> Shapes, Features; disabled
imp_it_9 = ImpIt(ShapefileShpPath=python_8.ans, Project2WGS84=False, TrueOrFalse=toggle_9)  # -> Shapes, Features; disabled
imp_it_10 = ImpIt(ShapefileShpPath=python_10.ans, Project2WGS84=False, TrueOrFalse=toggle_10)  # -> Shapes, Features
imp_it_11 = ImpIt(ShapefileShpPath=python_11.ans, Project2WGS84=False, TrueOrFalse=toggle_11)  # -> Shapes, Features
imp_it_12 = ImpIt(ShapefileShpPath=python_12.ans, Project2WGS84=False, TrueOrFalse=toggle_12)  # -> Shapes, Features
python_22 = GhPythonScript(x=panel_28, shapeFile=panel_16)  # -> out, a, ans; inputs shapeFile: list; disabled; same code as python
python_23 = GhPythonScript(x=panel_28, shapeFile=panel_21)  # -> out, a, ans; inputs shapeFile: list; disabled; same code as python
python_24 = GhPythonScript(x=panel_28, shapeFile=panel_17)  # -> out, a, ans; inputs shapeFile: list; disabled; same code as python
imp_it_13 = ImpIt(ShapefileShpPath=python_13.ans, Project2WGS84=False, TrueOrFalse=toggle_13)  # -> Shapes, Features
imp_it_14 = ImpIt(ShapefileShpPath=python_14.ans, Project2WGS84=False, TrueOrFalse=toggle_14)  # -> Shapes, Features; disabled
imp_it_15 = ImpIt(ShapefileShpPath=python_18.ans, Project2WGS84=False, TrueOrFalse=toggle_15)  # -> Shapes, Features; disabled
imp_it_16 = ImpIt(ShapefileShpPath=python_15.ans, Project2WGS84=False, TrueOrFalse=toggle_16)  # -> Shapes, Features; disabled
imp_it_17 = ImpIt(ShapefileShpPath=python_16.ans, Project2WGS84=False, TrueOrFalse=toggle_17)  # -> Shapes, Features; disabled
imp_it_18 = ImpIt(ShapefileShpPath=python_17.ans, Project2WGS84=False, TrueOrFalse=toggle_18)  # -> Shapes, Features; disabled
toggle_19 = BooleanToggle(True)  # disabled
number_slider_10 = Slider(5, range=0..100)  # disabled
toggle_20 = BooleanToggle(True)  # disabled
number_slider_11 = Slider(5, range=0..100)  # disabled
toggle_21 = BooleanToggle(True)  # disabled
number_slider_12 = Slider(1, range=0..100)  # disabled
toggle_22 = BooleanToggle(True)  # disabled
toggle_23 = BooleanToggle(True)  # disabled
number_slider_13 = Slider(1, range=0..100)  # disabled
toggle_24 = BooleanToggle(True)  # disabled
number_slider_14 = Slider(1, range=0..100)  # disabled
item = ListItem(List=imp_it.Features, Index=Slider(0, range=0..10), Wrap=True)
item_2 = ListItem(List=imp_it_2.Features, Index=Slider(0, range=0..100), Wrap=True)
item_3 = ListItem(List=imp_it_3.Features, Index=Slider(0, range=0..100), Wrap=True)
item_4 = ListItem(List=imp_it_4.Features, Index=Slider(0, range=0..100), Wrap=True)
item_5 = ListItem(List=imp_it_5.Features, Index=number_slider_8, Wrap=True)  # disabled
item_6 = ListItem(List=imp_it_6.Features, Index=Slider(8, range=0..10), Wrap=True)
item_7 = ListItem(List=imp_it_7.Features, Index=number_slider, Wrap=True)  # disabled
item_8 = ListItem(List=imp_it_8.Features, Index=number_slider_2, Wrap=True)  # disabled
item_9 = ListItem(List=imp_it_9.Features, Index=number_slider_3, Wrap=True)  # disabled
item_10 = ListItem(List=imp_it_10.Features, Index=Slider(5, range=0..100), Wrap=True)
item_11 = ListItem(List=imp_it_11.Features, Index=Slider(5, range=0..100), Wrap=True)
item_12 = ListItem(List=imp_it_12.Features, Index=Slider(5, range=0..100), Wrap=True)
panel_29 = Panel(imp_it.Features)
item_13 = ListItem(List=imp_it_13.Features, Index=Slider(5, range=0..10), Wrap=True)
item_14 = ListItem(List=imp_it_15.Features, Index=number_slider_4, Wrap=True)  # disabled
item_15 = ListItem(List=imp_it_14.Features, Index=number_slider_9, Wrap=True)  # disabled
panel_30 = Panel(imp_it_6.Features)
panel_31 = Panel(imp_it_15.Features)  # disabled
item_16 = ListItem(List=imp_it_16.Features, Index=number_slider_5, Wrap=True)  # disabled
item_17 = ListItem(List=imp_it_17.Features, Index=number_slider_6, Wrap=True)  # disabled
item_18 = ListItem(List=imp_it_18.Features, Index=number_slider_7, Wrap=True)  # disabled
datavis_it = DataVisIt(Shapes=imp_it.Shapes, GetValueofFeature=item, TrueOrFalse=toggle)  # -> Polygon, Polyline, Point, AttValues
datavis_it_2 = DataVisIt(Shapes=imp_it_2.Shapes, GetValueofFeature=item_2, TrueOrFalse=toggle_2)  # -> Polygon, Polyline, Point, AttValues
datavis_it_3 = DataVisIt(Shapes=imp_it_3.Shapes, GetValueofFeature=item_3, TrueOrFalse=toggle_3)  # -> Polygon, Polyline, Point, AttValues
datavis_it_4 = DataVisIt(Shapes=imp_it_4.Shapes, GetValueofFeature=item_4, TrueOrFalse=toggle_4)  # -> Polygon, Polyline, Point, AttValues
number_slider_15 = Slider(1, range=0..10)  # disabled
datavis_it_5 = DataVisIt(Shapes=imp_it_5.Shapes, GetValueofFeature=item_5, TrueOrFalse=toggle_5)  # -> Polygon, Polyline, Point, AttValues; disabled
datavis_it_6 = DataVisIt(Shapes=imp_it_7.Shapes, GetValueofFeature=item_7, TrueOrFalse=toggle_7)  # -> Polygon, Polyline, Point, AttValues; disabled
datavis_it_7 = DataVisIt(Shapes=imp_it_8.Shapes, GetValueofFeature=item_8, TrueOrFalse=toggle_8)  # -> Polygon, Polyline, Point, AttValues; disabled
datavis_it_8 = DataVisIt(Shapes=imp_it_9.Shapes, GetValueofFeature=item_9, TrueOrFalse=toggle_9)  # -> Polygon, Polyline, Point, AttValues; disabled
datavis_it_9 = DataVisIt(Shapes=imp_it_6.Shapes, GetValueofFeature=item_6, TrueOrFalse=toggle_6)  # -> Polygon, Polyline, Point, AttValues
datavis_it_10 = DataVisIt(Shapes=imp_it_10.Shapes, GetValueofFeature=item_10, TrueOrFalse=toggle_10)  # -> Polygon, Polyline, Point, AttValues
datavis_it_11 = DataVisIt(Shapes=imp_it_11.Shapes, GetValueofFeature=item_11, TrueOrFalse=toggle_11)  # -> Polygon, Polyline, Point, AttValues
datavis_it_12 = DataVisIt(Shapes=imp_it_12.Shapes, GetValueofFeature=item_12, TrueOrFalse=toggle_12)  # -> Polygon, Polyline, Point, AttValues
panel_32 = Panel(imp_it_5.Features)  # disabled
imp_it_19 = ImpIt(ShapefileShpPath=python_19.ans, Project2WGS84=False, TrueOrFalse=toggle_19)  # -> Shapes, Features; disabled
imp_it_20 = ImpIt(ShapefileShpPath=python_20.ans, Project2WGS84=False, TrueOrFalse=toggle_20)  # -> Shapes, Features; disabled
imp_it_21 = ImpIt(ShapefileShpPath=python_21.ans, Project2WGS84=False, TrueOrFalse=toggle_21)  # -> Shapes, Features; disabled
datavis_it_13 = DataVisIt(Shapes=imp_it_13.Shapes, GetValueofFeature=item_13, TrueOrFalse=toggle_13)  # -> Polygon, Polyline, Point, AttValues
datavis_it_14 = DataVisIt(Shapes=imp_it_15.Shapes, GetValueofFeature=item_14, TrueOrFalse=toggle_15)  # -> Polygon, Polyline, Point, AttValues; disabled
panel_33 = Panel(imp_it_14.Features)  # disabled
datavis_it_15 = DataVisIt(Shapes=imp_it_14.Shapes, GetValueofFeature=item_15, TrueOrFalse=toggle_14)  # -> Polygon, Polyline, Point, AttValues; disabled
datavis_it_16 = DataVisIt(Shapes=imp_it_16.Shapes, GetValueofFeature=item_16, TrueOrFalse=toggle_16)  # -> Polygon, Polyline, Point, AttValues; disabled
datavis_it_17 = DataVisIt(Shapes=imp_it_17.Shapes, GetValueofFeature=item_17, TrueOrFalse=toggle_17)  # -> Polygon, Polyline, Point, AttValues; disabled
datavis_it_18 = DataVisIt(Shapes=imp_it_18.Shapes, GetValueofFeature=item_18, TrueOrFalse=toggle_18)  # -> Polygon, Polyline, Point, AttValues; disabled
imp_it_22 = ImpIt(ShapefileShpPath=python_22.ans, Project2WGS84=False, TrueOrFalse=toggle_22)  # -> Shapes, Features; disabled
imp_it_23 = ImpIt(ShapefileShpPath=python_23.ans, Project2WGS84=False, TrueOrFalse=toggle_23)  # -> Shapes, Features; disabled
imp_it_24 = ImpIt(ShapefileShpPath=python_24.ans, Project2WGS84=False, TrueOrFalse=toggle_24)  # -> Shapes, Features; disabled
panel_34 = Panel(datavis_it.AttValues)
panel_35 = Panel(datavis_it_9.AttValues)
item_19 = ListItem(List=imp_it_19.Features, Index=number_slider_10, Wrap=True)  # disabled
item_20 = ListItem(List=imp_it_20.Features, Index=number_slider_11, Wrap=True)  # disabled
item_21 = ListItem(List=imp_it_21.Features, Index=number_slider_12, Wrap=True)  # disabled
item_22 = ListItem(List=imp_it_22.Features, Index=number_slider_15, Wrap=True)  # disabled
item_23 = ListItem(List=imp_it_23.Features, Index=number_slider_13, Wrap=True)  # disabled
item_24 = ListItem(List=imp_it_24.Features, Index=number_slider_14, Wrap=True)  # disabled
number_slider_16 = Slider(0.7, range=0..1)  # disabled
datavis_it_19 = DataVisIt(Shapes=imp_it_19.Shapes, GetValueofFeature=item_19, TrueOrFalse=toggle_19)  # -> Polygon, Polyline, Point, AttValues; disabled
datavis_it_20 = DataVisIt(Shapes=imp_it_20.Shapes, GetValueofFeature=item_20, TrueOrFalse=toggle_20)  # -> Polygon, Polyline, Point, AttValues; disabled
crv = Curve(datavis_it_3.Polyline)
crv_2 = Curve(datavis_it_4.Polyline)
datavis_it_21 = DataVisIt(Shapes=imp_it_21.Shapes, GetValueofFeature=item_21, TrueOrFalse=toggle_21)  # -> Polygon, Polyline, Point, AttValues; disabled
crv_3 = Curve(datavis_it_13.Polygon)
panel_36 = Panel(datavis_it_15.AttValues)  # disabled
crv_4 = Curve(datavis_it_15.Polygon)  # disabled
crv_5 = Curve(datavis_it_16.Polygon)  # disabled
crv_6 = Curve(datavis_it_17.Polygon)  # disabled
crv_7 = Curve(datavis_it_18.Polygon)  # disabled
crv_8 = Curve(datavis_it.Polyline)
crv_9 = Curve(datavis_it_2.Polyline)
datavis_it_22 = DataVisIt(Shapes=imp_it_22.Shapes, GetValueofFeature=item_22, TrueOrFalse=toggle_22)  # -> Polygon, Polyline, Point, AttValues; disabled
datavis_it_23 = DataVisIt(Shapes=imp_it_23.Shapes, GetValueofFeature=item_23, TrueOrFalse=toggle_23)  # -> Polygon, Polyline, Point, AttValues; disabled
datavis_it_24 = DataVisIt(Shapes=imp_it_24.Shapes, GetValueofFeature=item_24, TrueOrFalse=toggle_24)  # -> Polygon, Polyline, Point, AttValues; disabled
crv_10 = Curve(datavis_it_11.Polyline)
tmatch = MatchText(Text=datavis_it_11.AttValues, RegEx="일반", Case=True)
crv_11 = Curve(datavis_it_12.Polyline)
tmatch_2 = MatchText(Text=datavis_it_12.AttValues, RegEx="일반", Case=True)
crv_12 = Curve(datavis_it_14.Polygon)  # disabled
crv_13 = Curve(datavis_it_5.Polygon)  # disabled
crv_14 = Curve(datavis_it_6.Polygon)  # disabled
crv_15 = Curve(datavis_it_8.Polygon)  # disabled
crv_16 = Curve(datavis_it_9.Polyline)
tmatch_3 = MatchText(Text=datavis_it_9.AttValues, RegEx="일반", Case=True)
crv_17 = Curve(datavis_it_10.Polyline)
tmatch_4 = MatchText(Text=datavis_it_10.AttValues, RegEx="일반", Case=True)
Z = UnitZ(Factor=datavis_it_14.AttValues)  # disabled
cull = CullPattern(List=crv_10, CullPattern=invert(tmatch))
cull_2 = CullPattern(List=crv_11, CullPattern=invert(tmatch_2))
panel_37 = Panel(crv_13)  # disabled
multiplication = Multiplication(A=Z, B=number_slider_16)  # disabled
cull_3 = CullPattern(List=crv_16, CullPattern=invert(tmatch_3))
cull_4 = CullPattern(List=crv_17, CullPattern=invert(tmatch_4))
merge = Merge(Data1=crv_4, Data2=crv_5, Data3=crv_6, Data4=crv_7)  # -> flatten(Result); disabled
number_slider_17 = Slider(1, range=0..10)  # disabled
Z_2 = UnitZ(Factor=datavis_it_21.AttValues)  # disabled
number_slider_18 = Slider(0.7, range=0..1)  # disabled
Z_3 = UnitZ(Factor=datavis_it_22.AttValues)  # disabled
merge_2 = Merge(Data1=crv_8, Data2=crv_9, Data3=crv, Data4=crv_2)
Z_4 = UnitZ(Factor=datavis_it_23.AttValues)  # disabled
Z_5 = UnitZ(Factor=datavis_it_24.AttValues)  # disabled
number_slider_19 = Slider(0.7, range=0..1)  # disabled
boundary = BoundarySurfaces(Edges=crv_13)  # disabled
boundary_2 = BoundarySurfaces(Edges=crv_14)  # disabled
boundary_3 = BoundarySurfaces(Edges=crv_15)  # disabled
number_slider_20 = Slider(0.7, range=0..1)  # disabled
move = Move(Geometry=datavis_it_21.Polyline, Motion=Z_2)  # -> flatten(Geometry), Transform; disabled
crv_18 = Curve(datavis_it_20.Polygon)  # disabled
runion = RegionUnion(Curves=merge)  # disabled
move_2 = Move(Geometry=datavis_it_22.Polyline, Motion=Z_3)  # -> flatten(Geometry), Transform; disabled
move_3 = Move(Geometry=datavis_it_23.Polyline, Motion=Z_4)  # -> flatten(Geometry), Transform; disabled
move_4 = Move(Geometry=datavis_it_24.Polyline, Motion=Z_5)  # -> flatten(Geometry), Transform; disabled
Z_6 = UnitZ(Factor=datavis_it_13.AttValues)
crv_19 = Curve(datavis_it_19.Polygon)  # disabled
Z_7 = UnitZ(Factor=datavis_it_20.AttValues)  # disabled
panel_38 = Panel(cull)
panel_39 = Panel(cull_2)
Z_8 = UnitZ(Factor=multiplication)  # disabled
Z_9 = UnitZ(Factor=datavis_it_19.AttValues)  # disabled
panel_40 = Panel(cull_3)
panel_41 = Panel(cull_4)
redpline = Reduce(Polyline=runion, Tolerance=number_slider_17)  # -> Polyline, Reduction; disabled
boundary_4 = BoundarySurfaces(Edges=crv_3)
area = Area(Geometry=crv_3)  # -> Area, Centroid
multiplication_2 = Multiplication(A=Z_6, B=Slider(0.7, range=0..1))
multiplication_3 = Multiplication(A=Z_7, B=number_slider_18)  # disabled
crv_20 = Curve(move.Geometry)  # disabled
boundary_5 = BoundarySurfaces(Edges=crv_12)  # disabled
area_2 = Area(Geometry=crv_12)  # -> Area, Centroid; disabled
multiplication_4 = Multiplication(A=Z_8, B=number_slider_19)  # disabled
multiplication_5 = Multiplication(A=Z_9, B=number_slider_20)  # disabled
crv_21 = Curve(move_2.Geometry)  # disabled
crv_22 = Curve(move_3.Geometry)  # disabled
crv_23 = Curve(move_4.Geometry)  # disabled
merge_3 = Merge(Data1=boundary, Data2=boundary_2, Data3=boundary_3)  # -> flatten(Result); disabled
number_slider_21 = Slider(0.7, range=0..1)  # disabled
join = JoinCurves(Curves=redpline.Polyline, Preserve=False)  # disabled
number_slider_22 = Slider(0.7, range=0..1)  # disabled
Z_10 = UnitZ(Factor=1)
srf = Surface(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)
Z_11 = UnitZ(Factor=1)  # disabled
merge_4 = Merge(Data1=crv_21, Data2=crv_22, Data3=crv_23, Data4=crv_20)  # disabled
Z_12 = UnitZ(Factor=multiplication_3)  # disabled
merge_5 = Merge(Data1=cull_3, Data2=cull_4, Data3=cull, Data4=cull_2)
Z_13 = UnitZ(Factor=multiplication_5)  # disabled
runion_2 = RegionUnion(Curves=merge_3)  # disabled
number_slider_23 = Slider(10, range=0..10)  # disabled
crv_24 = Curve(merge_4)  # disabled
project = ProjectPoint(Point=area.Centroid, Direction=Z_10, Geometry=srf)  # -> Point, Index
boundary_6 = BoundarySurfaces(Edges=crv_18)  # disabled
area_3 = Area(Geometry=crv_18)  # -> Area, Centroid; disabled
project_2 = ProjectPoint(Point=area_2.Centroid, Direction=Z_11, Geometry=srf)  # -> Point, Index; disabled
multiplication_6 = Multiplication(A=Z_12, B=number_slider_21)  # disabled
boundary_7 = BoundarySurfaces(Edges=crv_19)  # disabled
area_4 = Area(Geometry=crv_19)  # -> Area, Centroid; disabled
multiplication_7 = Multiplication(A=Z_13, B=number_slider_22)  # disabled
bbox = BoundingBox(Content=crv_24, Plane=PlaneXY(0, 0, 0), UnionBox=True)  # -> Box, Box_2; disabled
null = NullItem(Item=project.Point)  # -> NullFlags, InvalidFlags, Description
null_2 = NullItem(Item=project_2.Point)  # -> NullFlags, InvalidFlags, Description; disabled
Z_14 = UnitZ(Factor=1)  # disabled
Z_15 = UnitZ(Factor=1)  # disabled
divlength = DivideLength(Curve=crv_24, Length=number_slider_23)  # -> Points, Tangents, Parameters; disabled
debrep = DeconstructBrep(Brep=bbox.Box)  # -> Faces, Edges, Vertices; disabled
cull_5 = CullPattern(List=boundary_4, CullPattern=invert(null.NullFlags))
cull_6 = CullPattern(List=area.Centroid, CullPattern=invert(null.NullFlags))
cull_7 = CullPattern(List=project.Point, CullPattern=invert(null.NullFlags))
cull_8 = CullPattern(List=multiplication_2, CullPattern=invert(null.NullFlags))
cull_9 = CullPattern(List=boundary_5, CullPattern=invert(null_2.NullFlags))  # disabled
cull_10 = CullPattern(List=area_2.Centroid, CullPattern=invert(null_2.NullFlags))  # disabled
cull_11 = CullPattern(List=project_2.Point, CullPattern=invert(null_2.NullFlags))  # disabled
cull_12 = CullPattern(List=multiplication_4, CullPattern=invert(null_2.NullFlags))  # disabled
project_3 = ProjectPoint(Point=area_3.Centroid, Direction=Z_14, Geometry=srf)  # -> Point, Index; disabled
area_5 = Area(Geometry=debrep.Faces)  # -> Area, Centroid; disabled
project_4 = ProjectPoint(Point=area_4.Centroid, Direction=Z_15, Geometry=srf)  # -> Point, Index; disabled
number_slider_24 = Slider(0.99, range=0..1)  # disabled
pdecon = Deconstruct(Point=area_5.Centroid)  # -> XComponent, YComponent, ZComponent; disabled
null_3 = NullItem(Item=project_3.Point)  # -> NullFlags, InvalidFlags, Description; disabled
null_4 = NullItem(Item=project_4.Point)  # -> NullFlags, InvalidFlags, Description; disabled
vec2pt = Vector2Pt(PointA=cull_6, PointB=cull_7, Unitize=False)  # -> Vector, Length
vec2pt_2 = Vector2Pt(PointA=cull_10, PointB=cull_11, Unitize=False)  # -> Vector, Length; disabled
panel_42 = Panel("-100")  # disabled
sort = SortList(Keys=pdecon.ZComponent, ValuesA=debrep.Faces)  # -> Keys, reverse(ValuesA); disabled
panel_43 = Panel("-1")  # disabled
cull_13 = CullPattern(List=boundary_6, CullPattern=invert(null_3.NullFlags))  # disabled
cull_14 = CullPattern(List=area_3.Centroid, CullPattern=invert(null_3.NullFlags))  # disabled
cull_15 = CullPattern(List=project_3.Point, CullPattern=invert(null_3.NullFlags))  # disabled
cull_16 = CullPattern(List=multiplication_6, CullPattern=invert(null_3.NullFlags))  # disabled
cull_17 = CullPattern(List=boundary_7, CullPattern=invert(null_4.NullFlags))  # disabled
cull_18 = CullPattern(List=area_4.Centroid, CullPattern=invert(null_4.NullFlags))  # disabled
cull_19 = CullPattern(List=project_4.Point, CullPattern=invert(null_4.NullFlags))  # disabled
cull_20 = CullPattern(List=multiplication_7, CullPattern=invert(null_4.NullFlags))  # disabled
multiplication_8 = Multiplication(A=vec2pt.Vector, B=Slider(0.99, range=0..1))
multiplication_9 = Multiplication(A=vec2pt_2.Vector, B=number_slider_24)  # disabled
number_slider_25 = Slider(0.99, range=0..1)  # disabled
item_25 = ListItem(List=sort.ValuesA, Index=0, Wrap=True)  # disabled
item_26 = ListItem(List=sort.ValuesA, Index=panel_43, Wrap=True)  # disabled
Z_16 = UnitZ(Factor=panel_42)  # disabled
number_slider_26 = Slider(5, range=0..100)  # disabled
number_slider_27 = Slider(0.99, range=0..1)  # disabled
move_5 = Move(Geometry=cull_5, Motion=multiplication_8)  # -> Geometry, Transform
disc = Discontinuity(Curve=item_25, Level=1)  # -> Points, Parameters; disabled
vec2pt_3 = Vector2Pt(PointA=cull_14, PointB=cull_15, Unitize=False)  # -> Vector, Length; disabled
move_6 = Move(Geometry=cull_9, Motion=multiplication_9)  # -> Geometry, Transform; disabled
vec2pt_4 = Vector2Pt(PointA=cull_18, PointB=cull_19, Unitize=False)  # -> Vector, Length; disabled
cp = ClosestPoint(Point=disc.Points, Cloud=flatten(divlength.Points))  # -> ClosestPoint, CPIndex, Distance; disabled
move_7 = Move(Geometry=item_26, Motion=Z_16)  # -> Geometry, Transform; disabled
panel_44 = Panel("-10")  # disabled
neg = Negative(Value=number_slider_26)  # disabled
extr = Extrude(Base=move_5.Geometry, Direction=cull_8)
multiplication_10 = Multiplication(A=vec2pt_3.Vector, B=number_slider_25)  # disabled
extr_2 = Extrude(Base=move_6.Geometry, Direction=cull_12)  # disabled
multiplication_11 = Multiplication(A=vec2pt_4.Vector, B=number_slider_27)  # disabled
xy = XYPlane(Origin=cp.ClosestPoint)  # disabled
offset = OffsetCurve(Curve=move_7.Geometry, Distance=neg, Corners=1)  # disabled
cap = CapHoles(Brep=extr)
move_8 = Move(Geometry=cull_13, Motion=multiplication_10)  # -> Geometry, Transform; disabled
cap_2 = CapHoles(Brep=extr_2)  # disabled
move_9 = Move(Geometry=cull_17, Motion=multiplication_11)  # -> Geometry, Transform; disabled
srf_2 = Surface(offset)  # disabled
project_5 = Project(Geometry=disc.Points, Plane=xy)  # -> Geometry, Transform; disabled
area_6 = Area(Geometry=srf_2)  # -> Area, Centroid; disabled
explode = Explode(Curve=srf_2, Recursive=True)  # -> Segments, Vertices; disabled
number_slider_28 = Slider(50, range=0..1000)  # disabled
extr_3 = Extrude(Base=move_8.Geometry, Direction=cull_16)  # disabled
extr_4 = Extrude(Base=move_9.Geometry, Direction=cull_20)  # disabled
len = Length(Curve=explode.Segments)  # disabled
del = DelaunayMesh(Points=flatten([divlength.Points, project_5.Geometry]), Plane=PlaneXY(0, 0, 0))  # disabled
xy_2 = XYPlane(Origin=area_6.Centroid)  # disabled
cap_3 = CapHoles(Brep=extr_3)  # disabled
cap_4 = CapHoles(Brep=extr_4)  # disabled
cset = CreateSet(List=len)  # -> Set, Map; disabled
integer_division = IntegerDivision(A=cset.Set, B=number_slider_28)  # disabled
item_27 = ListItem(List=integer_division, Index=0, Wrap=True)  # -> Item, Item1; disabled
sdivide = DivideSurface(Surface=srf_2, UCount=item_27.Item1, VCount=item_27.Item)  # -> Points, Normals, Parameters; disabled
Z_17 = UnitZ(Factor=1)  # disabled
meshray = MeshRay(Mesh=del, Point=sdivide.Points, Direction=Z_17)  # -> Point, Hit; disabled
srfgrid = SurfaceFromPoints(Points=flatten(meshray.Point), UCount=expr("x + 1", item_27.Item1), Interpolate=False)  # disabled
explode_2 = Explode(Curve=srfgrid, Recursive=True)  # -> Segments, Vertices; disabled
project_6 = Project(Geometry=explode_2.Segments, Plane=xy_2)  # -> Geometry, Transform; disabled
merge_6 = Merge(Data1=graft(explode_2.Segments), Data2=graft(project_6.Geometry))  # disabled
loft = Loft(Curves=merge_6, Options={Adjust=False, Closed=False, LoftEnds=0, LoftSimp=0, LoftType=0, Rebuild=10, Refit=0.01})  # disabled
join_2 = BrepJoin(Breps=flatten([loft, srf_2, srfgrid]))  # -> Breps, Closed; disabled
